# Grasshopper definition trajectory_planning.gh (Grasshopper 1.0.7)

curve = Curve(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)
end_points = EndPoints(Curve=curve)  # -> Start, End
divide_curve = DivideCurve(Curve=curve, Count=Slider(200, range=0..1000), Kinks=False)  # -> Points, Tangents, Parameters
point = Point(end_points.Start)
ghpython_script = GhPythonScript(x=divide_curve.Points)  # -> out, a; inputs x: list of Point3d
# ---------- ghpython_script: Python ----------
import Rhino.Geometry as rg

for p in x:
    print([p.X, p.Y, p.Z, 0.0])
# ---------- end ghpython_script ----------
panel = Panel(ghpython_script.out)
