# Grasshopper definition visualization.gh (Grasshopper 1.0.7)

read_file = ReadFile(
    File="C:\Users\77777777\source\repos\machine_perception\demo2.2_detect_cylinder\detection_rgbd\data\point_cloud\point_params.txt",
    PerLineParse=True)
read_file_2 = ReadFile(
    File="C:\Users\77777777\source\repos\machine_perception\demo2.2_detect_cylinder\detection_rgbd\data\point_cloud\cylinder_params.txt",
    PerLineParse=True)
panel = Panel(read_file)
panel_2 = Panel(read_file_2)
number = Number(expr("x*1000", panel_2))
number_2 = Number(expr("x*1000", panel))
file = File("C:\Users\77777777\source\repos\machine_perception\demo2.2_detect_cylinder\detection_rgbd\data\point_cloud\points.txt")
list_item = ListItem(List=number, Index=0, Wrap=True)  # -> Item, Item1, Item2, Item3, Item4, Item5, Item6, Item7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
list_item_2 = ListItem(List=number_2, Index=0, Wrap=True)  # -> Item, Item1, Item2, Item3, Item4, Item5
ghpython_script = GhPythonScript()  # -> out, pc; disabled
# ---------- ghpython_script: Python ----------
import Rhino.Geometry as rg
import Grasshopper as gh

f = open("C:\points.txt",'r')
count = 0
pc = []

try:
    lines = f.readlines()
    for line in lines:
        nums = line.split(" ")
        x = float(nums[0].replace("\n", ""))
        y = float(nums[1].replace("\n", ""))
        z = float(nums[2].replace("\n", ""))
        
        pc.Add(1000 * rg.Point3d(x, y, z))
        count += 1
finally:
    f.close()
    
print count
# ---------- end ghpython_script ----------
ghpython_script_2 = GhPythonScript(path=file)  # -> out, pc
# ---------- ghpython_script_2: Python ----------
import Rhino.Geometry as rg
import Grasshopper as gh

f = open(path,'r')
count = 0
pc = []

try:
    lines = f.readlines()
    for line in lines:
        nums = line.split(" ")
        x = float(nums[0].replace("\n", ""))
        y = float(nums[1].replace("\n", ""))
        z = float(nums[2].replace("\n", ""))
        
        pc.Add(1000 * rg.Point3d(x, y, z))
        count += 1
finally:
    f.close()
    
print count
# ---------- end ghpython_script_2 ----------
number_slider = Slider(0.53, range=0..1)  # disabled
number_slider_2 = Slider(0.73, range=0..1)  # disabled
construct_point = ConstructPoint(XCoordinate=list_item_2.Item3, YCoordinate=list_item_2.Item4, ZCoordinate=list_item_2.Item5)
vector_xyz = VectorXYZ(XComponent=list_item.Item4, YComponent=list_item.Item5, ZComponent=list_item.Item6)  # -> Vector, Length
flip_matrix = FlipMatrix(Data=ghpython_script.pc)  # disabled
construct_point_2 = ConstructPoint(XCoordinate=list_item.Item1, YCoordinate=list_item.Item2, ZCoordinate=list_item.Item3)
construct_point_3 = ConstructPoint(XCoordinate=list_item_2.Item, YCoordinate=list_item_2.Item1, ZCoordinate=list_item_2.Item2)
vector_xyz_2 = VectorXYZ(XComponent=list_item.Item11, YComponent=list_item.Item12, ZComponent=list_item.Item13)  # -> Vector, Length
construct_point_4 = ConstructPoint(XCoordinate=list_item.Item8, YCoordinate=list_item.Item9, ZCoordinate=list_item.Item10)
panel_3 = Panel(ghpython_script.out)
ghpython_script_3 = GhPythonScript(data=flip_matrix)  # -> out, new_data; inputs data: tree of Point3d; disabled
# ---------- ghpython_script_3: Python ----------
import Grasshopper as gh
import Rhino.Geometry as rg

new_data = gh.DataTree[rg.Point3d]()

for i in range(data.BranchCount):
    if i%10 != 0:
        continue
    new_data.EnsurePath(i/10)
    new_data.AddRange(data.Branch(i))
# ---------- end ghpython_script_3 ----------
vector_xyz_3 = VectorXYZ(XComponent=Slider(10, range=-10..10), YComponent=Slider(-0.26, range=-10..10), ZComponent=Slider(-20, range=-20..10))  # -> Vector, Length
custom_preview = CustomPreview(Geometry=ghpython_script_2.pc, Material=ColourSwatch(SwatchColor=RGB(199, 199, 199)))
vector_xyz_4 = VectorXYZ(XComponent=Slider(-10, range=-10..10), YComponent=Slider(2.8, range=-10..10), ZComponent=Slider(-17.96, range=-20..10))  # -> Vector, Length
construct_domain = ConstructDomain(DomainStart=number_slider, DomainEnd=number_slider_2)  # disabled
move = Move(Geometry=construct_point, Motion=vector_xyz_3.Vector)  # -> Geometry, Transform
move_2 = Move(Geometry=construct_point_3, Motion=vector_xyz_4.Vector)  # -> Geometry, Transform
line_sdl = LineSDL(Start=construct_point_2, Direction=vector_xyz.Vector, Length=expr("x*3", vector_xyz.Length))
line_sdl_2 = LineSDL(Start=construct_point_4, Direction=vector_xyz_2.Vector, Length=expr("x*3", vector_xyz_2.Length))
curve = Curve(reparameterize([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]))  # disabled
move_3 = Move(Geometry=line_sdl_2, Motion=expr("-0.5*x", line_sdl_2))  # -> Geometry, Transform
number_slider_3 = Slider(3, range=0..10)  # disabled
interpolate = Interpolate(Vertices=ghpython_script_3.new_data, Degree=3, Periodic=False, KnotStyle=1)  # -> Curve, Length, Domain; disabled
sub_curve = SubCurve(BaseCurve=curve, Domain=construct_domain)  # disabled
pipe = Pipe(Curve=line_sdl, Radius=list_item.Item, Caps=0)
brep_closest_point = BrepClosestPoint(Point=move.Geometry, Brep=pipe)  # -> Point, Normal, Distance
pipe_2 = Pipe(Curve=move_3.Geometry, Radius=list_item.Item7, Caps=0)
brep_closest_point_2 = BrepClosestPoint(Point=move_2.Geometry, Brep=pipe_2)  # -> Point, Normal, Distance
curve_2 = Curve(interpolate.Curve)  # disabled
rebuild_curve = RebuildCurve(Curve=sub_curve, Degree=3, Count=number_slider_3, Tangents=False)  # disabled
ghpython_script_4 = GhPythonScript(x=brep_closest_point_2.Point, y=brep_closest_point.Point)  # -> out, a; inputs x: Point3d, y: Point3d
# ---------- ghpython_script_4: Python ----------
a = x + x - y
# ---------- end ghpython_script_4 ----------
ghpython_script_5 = GhPythonScript(x=brep_closest_point.Point, y=brep_closest_point_2.Point)  # -> out, a; inputs x: Point3d, y: Point3d; same code as ghpython_script_4
loft = Loft(Curves=rebuild_curve, Options={Adjust=False, Closed=False, LoftEnds=0, LoftSimp=0, LoftType=0, Rebuild=10, Refit=0.01})  # disabled
line = Line(StartPoint=ghpython_script_4.a, EndPoint=ghpython_script_5.a)
