# Grasshopper definition fakedata.gh (Grasshopper 1.0.7)
# plug-ins: Virtual Robot

number_slider = Slider(-86, range=-180..180)  # disabled
number_slider_2 = Slider(74, range=-180..180)  # disabled
number_slider_3 = Slider(-35, range=-180..180)  # disabled
number_slider_4 = Slider(-28, range=-180..180)  # disabled
number_slider_5 = Slider(148, range=-180..180)  # disabled
number_slider_6 = Slider(-44, range=-180..180)  # disabled
predefined_kuka_kr_125_2 = PredefinedKUKAKR1252(RobRootFrame=PlaneXY(0, 0, 0))  # disabled

panel = Panel("""0
0
0
1""")
panel_2 = Panel("""0
1
0
1""")
matrix = Matrix({0;0=0.7038745262, 0;1=0.5982095195, 0;2=0.3830222216, 0;3=9, 1;0=-0.2620026302, 1;1=0.7198463104, 1;2=-0.6427876097, 1;3=10, 2;0=-0.6602388001, 2;1=0.3520889947, 2;2=0.6634139482, 2;3=8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})
construct_matrix = ConstructMatrix(Rows=4, Columns=1, Values=panel)
construct_matrix_2 = ConstructMatrix(Rows=4, Columns=1, Values=panel_2)
pose2plane = Pose2plane(matrix=matrix)  # disabled
multiplication = Multiplication(A=matrix, B=construct_matrix)
deconstruct_matrix = DeconstructMatrix(Matrix=matrix)  # -> Rows, Columns, Values
display_matrix = DisplayMatrix(matrix)
multiplication_2 = Multiplication(A=matrix, B=construct_matrix_2)
subtraction = Subtraction(A=multiplication_2, B=multiplication)
panel_3 = Panel(deconstruct_matrix.Values)
display_matrix_2 = DisplayMatrix(subtraction)

xy_plane = XYPlane(Origin=Point(0, 0, 0))
plane = Plane(Plane(origin=(-3.701866671, 9.170011198, 2.705691567), x=(0.9359559331, 0.1799010912, 0.3026914083), y=(-0.2517361652, 0.9429286872, 0.2179779666)))
plane_2 = Plane(Plane(origin=(9, 10, 8), x=(0.7038745262, -0.2620026302, -0.6602388001), y=(0.5982095195, 0.7198463104, 0.3520889947)))
cluster = Cluster(plane=xy_plane)
orient = Orient(Source=xy_plane, Target=plane_2)  # -> Geometry, Transform
orient_2 = Orient(Geometry=plane_2, Source=PlaneXY(0, 0, 0), Target=plane)  # -> Geometry, Transform
plane2matrix = Plane2matrix(target=plane)
plane2matrix_2 = Plane2matrix(target=plane_2)
panel_4 = Panel(orient.Transform)
multiplication_3 = Multiplication(A=plane2matrix, B=plane2matrix_2)
pose2plane_2 = Pose2plane(matrix=multiplication_3)
transform = Transform(Geometry=cluster, Transform=multiplication_3)

plane_3 = Plane(Plane(origin=(9, 10, 8), x=(0.7038745262, -0.2620026302, -0.6602388001), y=(0.5982095195, 0.7198463104, 0.3520889947)))
plane_4 = Plane(Plane(origin=(-3.701866671, 9.170011198, 2.705691567), x=(0.9359559331, 0.1799010912, 0.3026914083), y=(-0.2517361652, 0.9429286872, 0.2179779666)))
cluster_2 = Cluster(plane=plane_4)
plane2matrix_3 = Plane2matrix(target=plane_3)
plane2matrix_4 = Plane2matrix(target=plane_4)
orient_3 = Orient(Geometry=cluster_2, Source=plane_4, Target=plane_3)  # -> Geometry, Transform
invert_matrix = InvertMatrix(Matrix=plane2matrix_4, Tolerance=0)  # -> Matrix, Success
matrix_2 = Matrix(orient_3.Transform)
multiplication_4 = Multiplication(A=invert_matrix.Matrix, B=plane2matrix_3)
pose2plane_3 = Pose2plane(matrix=matrix_2)
display_matrix_3 = DisplayMatrix(matrix_2)
pose2plane_4 = Pose2plane(matrix=multiplication_4)
display_matrix_4 = DisplayMatrix(multiplication_4)

merge = Merge(
    Data1=number_slider_4,
    Data2=number_slider,
    Data3=number_slider_2,
    Data4=number_slider_5,
    Data5=number_slider_3,
    Data6=number_slider_6)  # disabled

# ----
# end to camera
plane_5 = Plane(Plane(origin=(0, 2.819077862, 24.97393957), x=(0.9559237072, 0.1644949642, -0.2432103468), y=(-0.2432103468, 0.9076733712, -0.3420201433)))  # disabled
plane2matrix_5 = Plane2matrix(target=plane_5)  # disabled

# ----
# world to object
plane_6 = Plane(PlaneXY(1810, 1530, 0))  # disabled
plane2matrix_6 = Plane2matrix(target=plane_6)  # disabled

# ----
# world to end
robot_forward_kinematics = RobotForwardKinematics(Robot=predefined_kuka_kr_125_2, AxisValues=merge, useColorPreview=True)  # -> PoseGeometry, TCPFrame; disabled
plane2matrix_7 = Plane2matrix(target=robot_forward_kinematics.TCPFrame)  # disabled

plane_7 = Plane(robot_forward_kinematics.TCPFrame)  # disabled

deconstruct_matrix_2 = DeconstructMatrix(Matrix=plane2matrix_5)  # -> Rows, Columns, Values; disabled
text = Text(flatten(deconstruct_matrix_2.Values))  # disabled
panel_5 = Panel(" ")  # disabled
panel_6 = Panel("e2c:")  # disabled
text_join = TextJoin(Text=[panel_6, text], Join=panel_5)  # disabled
panel_7 = Panel(text_join)  # disabled

deconstruct_matrix_3 = DeconstructMatrix(Matrix=plane2matrix_7)  # -> Rows, Columns, Values; disabled
text_2 = Text(flatten(deconstruct_matrix_3.Values))  # disabled
panel_8 = Panel("w2e:")  # disabled
panel_9 = Panel(" ")  # disabled
text_join_2 = TextJoin(Text=[panel_8, text_2], Join=panel_9)  # disabled
panel_10 = Panel(text_join_2)  # disabled

# ----
# world to camera
multiplication_5 = Multiplication(A=plane2matrix_7, B=plane2matrix_5)  # disabled
invert_matrix_2 = InvertMatrix(Matrix=multiplication_5, Tolerance=0)  # -> Matrix, Success; disabled
# camera to object
multiplication_6 = Multiplication(A=invert_matrix_2.Matrix, B=plane2matrix_6)  # disabled

deconstruct_matrix_4 = DeconstructMatrix(Matrix=multiplication_6)  # -> Rows, Columns, Values; disabled
text_3 = Text(flatten(deconstruct_matrix_4.Values))  # disabled
panel_11 = Panel(" ")  # disabled
panel_12 = Panel("c20:")  # disabled
text_join_3 = TextJoin(Text=[panel_12, text_3], Join=panel_11)
panel_13 = Panel(text_join_3)  # disabled

pose2plane_5 = Pose2plane(matrix=multiplication_6)  # disabled
plane_8 = Plane(Plane(origin=(1445.646076, 855.4518804, 2033.987707), x=(0.5562781309, -0.821274121, 0.1267417029), y=(-0.4443703292, -0.4228660005, -0.7897590494)))
# end to camera
matrix_3 = Matrix({0;0=0.9559237072, 0;1=-0.2432103468, 0;2=0.1644949642, 0;3=0, 1;0=0.1644949642, 1;1=0.9076733712, 1;2=0.3860964361, 1;3=2.819077862, 2;0=-0.2432103468, 2;1=-0.3420201433, 2;2=0.9076733712, 2;3=24.97393957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})
invert_matrix_3 = InvertMatrix(Matrix=matrix_3, Tolerance=0)  # -> Matrix, Success
plane2matrix_8 = Plane2matrix(target=plane_8)
predefined_kuka_kr_125_2_2 = PredefinedKUKAKR1252(RobRootFrame=PlaneXY(0, 0, 0))
multiplication_7 = Multiplication(A=plane2matrix_8, B=invert_matrix_3.Matrix)
pose2plane_6 = Pose2plane(matrix=multiplication_7)
robot_inverse_kinematics = RobotInverseKinematics(Robot=predefined_kuka_kr_125_2_2, TargetTCPFrame=pose2plane_6, AxisToggles=[False, False, False], useColorPreview=True)  # -> PoseGeometry, AxisValues

# ==== cluster Plane2matrix
xy_plane = XYPlane(Origin=Point(0, 0, 0))
target = ClusterInput()
orient = Orient(Source=xy_plane, Target=target)  # -> Geometry, Transform
matrix = Matrix(orient.Transform)
matrix_2 = ClusterOutput(matrix)

# ==== cluster Pose2plane
matrix = ClusterInput()
deconstruct_matrix = DeconstructMatrix(Matrix=matrix)  # -> Rows, Columns, Values
panel = Panel("""3
7
11""")
panel_2 = Panel("""0
4
8""")
panel_3 = Panel("""1
5
9""")
list_item = ListItem(List=deconstruct_matrix.Values, Index=panel, Wrap=True)
list_item_2 = ListItem(List=deconstruct_matrix.Values, Index=panel_2, Wrap=True)
list_item_3 = ListItem(List=deconstruct_matrix.Values, Index=panel_3, Wrap=True)
list_item_4 = ListItem(List=list_item, Index=0, Wrap=True)  # -> Item, Item1, Item2
list_item_5 = ListItem(List=list_item_2, Index=0, Wrap=True)  # -> Item, Item1, Item2
list_item_6 = ListItem(List=list_item_3, Index=0, Wrap=True)  # -> Item, Item1, Item2
construct_point = ConstructPoint(XCoordinate=list_item_4.Item, YCoordinate=list_item_4.Item1, ZCoordinate=list_item_4.Item2)
vector_xyz = VectorXYZ(XComponent=list_item_5.Item, YComponent=list_item_5.Item1, ZComponent=list_item_5.Item2)  # -> Vector, Length
vector_xyz_2 = VectorXYZ(XComponent=list_item_6.Item, YComponent=list_item_6.Item1, ZComponent=list_item_6.Item2)  # -> Vector, Length
construct_plane = ConstructPlane(Origin=construct_point, XAxis=vector_xyz.Vector, YAxis=vector_xyz_2.Vector)
plane = ClusterOutput(construct_plane)

# ==== cluster Cluster
plane = ClusterInput()
rectangle = Rectangle(Plane=plane, XSize=Domain(-1, 1), YSize=Domain(-2, 2), Radius=0)  # -> Rectangle, Length
deconstruct_plane = DeconstructPlane(Plane=plane)  # -> Origin, XAxis, YAxis, ZAxis
extrude = Extrude(Base=rectangle.Rectangle, Direction=expr("x*5", deconstruct_plane.ZAxis))
cap_holes = CapHoles(Brep=extrude)
brep = ClusterOutput(cap_holes)
