# Grasshopper definition matrix_transformation.gh (Grasshopper 1.0.7)
# plug-ins: Virtual Robot

# ----
# Plane 1
# T(Word -> Plane 1)
# T(World -> Plane 3)
# Plane 2
# T(Word -> Plane 2)
# [PS: T(P1 -> P3) = T(W -> P2)]
# Plane 3
xy_plane = XYPlane(Origin=Point(0, 0, 0))
plane_1 = Plane(Plane(origin=(9, 10, 8), x=(0.7038745262, -0.2620026302, -0.6602388001), y=(0.5982095195, 0.7198463104, 0.3520889947)))
plane_2 = Plane(Plane(origin=(-3.701866671, 9.170011198, 2.705691567), x=(0.9359559331, 0.1799010912, 0.3026914083), y=(-0.2517361652, 0.9429286872, 0.2179779666)))
orient = Orient(Geometry=plane_1, Source=PlaneXY(0, 0, 0), Target=plane_2)  # -> Geometry, Transform
orient_2 = Orient(Source=xy_plane, Target=plane_1)  # -> Geometry, Transform
cluster = Cluster(plane=xy_plane)
plane2matrix = Plane2matrix(target=plane_2)
plane2matrix_2 = Plane2matrix(target=plane_1)
panel = Panel(orient_2.Transform)
multiplication = Multiplication(A=plane2matrix, B=plane2matrix_2)
pose2plane = Pose2plane(matrix=multiplication)
transform = Transform(Geometry=cluster, Transform=multiplication)
plane_3 = Plane(pose2plane)

# ----
# transformed plane from transformation matrix
# pose: orientation + position
# transformation matrix
# get x axis vector from the transformed plane
panel_2 = Panel("""0
0
0
1""")
panel_3 = Panel("""1
0
0
1""")
matrix = Matrix({0;0=0.7038745262, 0;1=0.5982095195, 0;2=0.3830222216, 0;3=9, 1;0=-0.2620026302, 1;1=0.7198463104, 1;2=-0.6427876097, 1;3=10, 2;0=-0.6602388001, 2;1=0.3520889947, 2;2=0.6634139482, 2;3=8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})
construct_matrix = ConstructMatrix(Rows=4, Columns=1, Values=panel_2)
construct_matrix_2 = ConstructMatrix(Rows=4, Columns=1, Values=panel_3)
deconstruct_matrix = DeconstructMatrix(Matrix=matrix)  # -> Rows, Columns, Values
display_matrix = DisplayMatrix(matrix)
pose2plane_2 = Pose2plane(matrix=matrix)
multiplication_2 = Multiplication(A=matrix, B=construct_matrix_2)
multiplication_3 = Multiplication(A=matrix, B=construct_matrix)
subtraction = Subtraction(A=multiplication_2, B=multiplication_3)
panel_4 = Panel(deconstruct_matrix.Values)
display_matrix_2 = DisplayMatrix(subtraction)

# ----
# Plane 1
# T (P1 -> P2)
# Plane 2
plane = Plane(Plane(origin=(9, 10, 8), x=(0.7038745262, -0.2620026302, -0.6602388001), y=(0.5982095195, 0.7198463104, 0.3520889947)))
plane_4 = Plane(Plane(origin=(-3.701866671, 9.170011198, 2.705691567), x=(0.9359559331, 0.1799010912, 0.3026914083), y=(-0.2517361652, 0.9429286872, 0.2179779666)))
plane2matrix_3 = Plane2matrix(target=plane_4)
plane2matrix_4 = Plane2matrix(target=plane)
invert_matrix = InvertMatrix(Matrix=plane2matrix_3, Tolerance=0)  # -> Matrix, Success
multiplication_4 = Multiplication(A=invert_matrix.Matrix, B=plane2matrix_4)
pose2plane_3 = Pose2plane(matrix=multiplication_4)
display_matrix_3 = DisplayMatrix(multiplication_4)

# ----
# This does not work because it uses the world origin to do the orientation first.
# The orientation need to be done using the center of the plane itself.
cluster_2 = Cluster(plane=plane_4)
orient_3 = Orient(Geometry=cluster_2, Source=plane_4, Target=plane)  # -> Geometry, Transform
matrix_2 = Matrix(orient_3.Transform)
pose2plane_4 = Pose2plane(matrix=matrix_2)
display_matrix_4 = DisplayMatrix(matrix_2)

# ----
# Calculate the T(World -> 6) based on T(6 -> Camera) and target T(World -> Camera)
# end to camera
# [PS: T(6 -> Camera)]
# T(World->6)
# target camera pose
# [PS: T(World ->Camera)]
matrix_3 = Matrix({0;0=0.9559237072, 0;1=-0.2432103468, 0;2=0.1644949642, 0;3=0, 1;0=0.1644949642, 1;1=0.9076733712, 1;2=0.3860964361, 1;3=2.819077862, 2;0=-0.2432103468, 2;1=-0.3420201433, 2;2=0.9076733712, 2;3=24.97393957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})
plane_5 = Plane(Plane(origin=(1445.646076, 855.4518804, 2033.987707), x=(0.5562781309, -0.821274121, 0.1267417029), y=(-0.4443703292, -0.4228660005, -0.7897590494)))
plane2matrix_5 = Plane2matrix(target=plane_5)
invert_matrix_2 = InvertMatrix(Matrix=matrix_3, Tolerance=0)  # -> Matrix, Success
multiplication_5 = Multiplication(A=plane2matrix_5, B=invert_matrix_2.Matrix)
predefined_kuka_kr_125_2 = PredefinedKUKAKR1252(RobRootFrame=PlaneXY(0, 0, 0))
pose2plane_5 = Pose2plane(matrix=multiplication_5)
robot_inverse_kinematics = RobotInverseKinematics(Robot=predefined_kuka_kr_125_2, TargetTCPFrame=pose2plane_5, AxisToggles=[False, False, False], useColorPreview=True)  # -> PoseGeometry, AxisValues

# ==== cluster Pose2plane
matrix = ClusterInput()
deconstruct_matrix = DeconstructMatrix(Matrix=matrix)  # -> Rows, Columns, Values
panel = Panel("""3
7
11""")
panel_2 = Panel("""0
4
8""")
panel_3 = Panel("""1
5
9""")
list_item = ListItem(List=deconstruct_matrix.Values, Index=panel, Wrap=True)
list_item_2 = ListItem(List=deconstruct_matrix.Values, Index=panel_2, Wrap=True)
list_item_3 = ListItem(List=deconstruct_matrix.Values, Index=panel_3, Wrap=True)
list_item_4 = ListItem(List=list_item, Index=0, Wrap=True)  # -> Item, Item1, Item2
list_item_5 = ListItem(List=list_item_2, Index=0, Wrap=True)  # -> Item, Item1, Item2
list_item_6 = ListItem(List=list_item_3, Index=0, Wrap=True)  # -> Item, Item1, Item2
construct_point = ConstructPoint(XCoordinate=list_item_4.Item, YCoordinate=list_item_4.Item1, ZCoordinate=list_item_4.Item2)
vector_xyz = VectorXYZ(XComponent=list_item_5.Item, YComponent=list_item_5.Item1, ZComponent=list_item_5.Item2)  # -> Vector, Length
vector_xyz_2 = VectorXYZ(XComponent=list_item_6.Item, YComponent=list_item_6.Item1, ZComponent=list_item_6.Item2)  # -> Vector, Length
construct_plane = ConstructPlane(Origin=construct_point, XAxis=vector_xyz.Vector, YAxis=vector_xyz_2.Vector)
plane = ClusterOutput(construct_plane)

# ==== cluster Plane2matrix
xy_plane = XYPlane(Origin=Point(0, 0, 0))
target = ClusterInput()
orient = Orient(Source=xy_plane, Target=target)  # -> Geometry, Transform
matrix = Matrix(orient.Transform)
matrix_2 = ClusterOutput(matrix)

# ==== cluster Cluster
plane = ClusterInput()
rectangle = Rectangle(Plane=plane, XSize=Domain(-1, 1), YSize=Domain(-2, 2), Radius=0)  # -> Rectangle, Length
deconstruct_plane = DeconstructPlane(Plane=plane)  # -> Origin, XAxis, YAxis, ZAxis
extrude = Extrude(Base=rectangle.Rectangle, Direction=expr("x*5", deconstruct_plane.ZAxis))
cap_holes = CapHoles(Brep=extrude)
brep = ClusterOutput(cap_holes)
