# Grasshopper definition matrix_funcs.gh (Grasshopper 1.0.7)

# transform a plane by a 4*4 matrix
transform_plane_with_matrix = Transform_plane_with_matrix()
# 4*4 transformation matrix -> a frame representing the pose
matrix2plane = Matrix2plane()

# ----
# example
panel = Panel("4")
panel_2 = Panel("""1.0
0.0
0.0
0.0
0.0
0.0
-1.0
0.0
0.0
1.0
0.0
30.0
0.0
0.0
0.0
1.0""")
plane = Plane(PlaneXZ(0, 0, 30))
construct_matrix = ConstructMatrix(Rows=panel, Columns=panel, Values=panel_2)
display_matrix = DisplayMatrix(construct_matrix)
transform_plane_with_matrix_2 = Transform_plane_with_matrix(plane=plane, matrix=construct_matrix)
plane_2 = Plane(transform_plane_with_matrix_2)

# ----
# example
panel_3 = Panel("4")
panel_4 = Panel("""1.0
0.0
0.0
0.0
0.0
0.0
-1.0
0.0
0.0
1.0
0.0
30.0
0.0
0.0
0.0
1.0""")
construct_matrix_2 = ConstructMatrix(Rows=panel_3, Columns=panel_3, Values=panel_4)
pose2plane = Matrix2plane(matrix=construct_matrix_2)
display_matrix_2 = DisplayMatrix(construct_matrix_2)
plane_3 = Plane(pose2plane)

# ----
# get 4*4 transformation matrix between two planes
transformation_from_planes = Transformation_from_planes()

# ----
# example
plane_4 = Plane(Plane(origin=(0, -30, 30), x=(1, 0, 0), y=(0, -1, 0)))
plane_5 = Plane(PlaneXZ(0, 0, 30))
transformation_from_planes_2 = Transformation_from_planes(plane=plane_5, plane_2=plane_4)
matrix = Matrix(transformation_from_planes_2)
display_matrix_3 = DisplayMatrix(matrix)

# ----
# a frame representing the pose -> 4*4 transformation matrix
plane2matrix = Plane2matrix(target=PlaneXY(0, 0, 0))

# ----
# example
plane_6 = Plane(PlaneXZ(0, 0, 30))
plane2matrix_2 = Plane2matrix(target=plane_6)
display_matrix_4 = DisplayMatrix(plane2matrix_2)

# ==== cluster Matrix2plane
matrix = ClusterInput()
deconstruct_matrix = DeconstructMatrix(Matrix=matrix)  # -> Rows, Columns, Values
panel = Panel("""3
7
11""")
panel_2 = Panel("""0
4
8""")
panel_3 = Panel("""1
5
9""")
list_item = ListItem(List=deconstruct_matrix.Values, Index=panel, Wrap=True)
list_item_2 = ListItem(List=deconstruct_matrix.Values, Index=panel_2, Wrap=True)
list_item_3 = ListItem(List=deconstruct_matrix.Values, Index=panel_3, Wrap=True)
list_item_4 = ListItem(List=list_item, Index=0, Wrap=True)  # -> Item, Item1, Item2
list_item_5 = ListItem(List=list_item_2, Index=0, Wrap=True)  # -> Item, Item1, Item2
list_item_6 = ListItem(List=list_item_3, Index=0, Wrap=True)  # -> Item, Item1, Item2
construct_point = ConstructPoint(XCoordinate=list_item_4.Item, YCoordinate=list_item_4.Item1, ZCoordinate=list_item_4.Item2)
vector_xyz = VectorXYZ(XComponent=list_item_5.Item, YComponent=list_item_5.Item1, ZComponent=list_item_5.Item2)  # -> Vector, Length
vector_xyz_2 = VectorXYZ(XComponent=list_item_6.Item, YComponent=list_item_6.Item1, ZComponent=list_item_6.Item2)  # -> Vector, Length
construct_plane = ConstructPlane(Origin=construct_point, XAxis=vector_xyz.Vector, YAxis=vector_xyz_2.Vector)
plane = ClusterOutput(construct_plane)

# ==== cluster Plane2matrix
xy_plane = XYPlane(Origin=Point(0, 0, 0))
target = ClusterInput()
orient = Orient(Source=xy_plane, Target=target)  # -> Geometry, Transform
matrix = Matrix(orient.Transform)
matrix_2 = ClusterOutput(matrix)

# ==== cluster Transform_plane_with_matrix
plane = ClusterInput()
matrix = ClusterInput()
plane2matrix = Plane2matrix(target=plane)
matrix_2 = Matrix(matrix)
multiplication = Multiplication(A=plane2matrix, B=matrix_2)
pose2plane = Matrix2plane(matrix=multiplication)
plane_2 = ClusterOutput(pose2plane)

# ==== cluster Transformation_from_planes
plane = ClusterInput()
plane_2 = ClusterInput()
plane2matrix = Plane2matrix(target=plane)
plane2matrix_2 = Plane2matrix(target=plane_2)
invert_matrix = InvertMatrix(Matrix=plane2matrix, Tolerance=0)  # -> Matrix, Success
multiplication = Multiplication(A=invert_matrix.Matrix, B=plane2matrix_2)
result = ClusterOutput(multiplication)
