# Grasshopper definition result_visualization.gh (Grasshopper 1.0.7)

panel = Panel("0 0 0 0 0 0")

# ---- group: l : new
read_file = ReadFile(File="C:\Users\77777777\source\repos\machine_perception\demo4.1_tracking\opt\data\l.txt", PerLineParse=True)

# ---- group: m : exsiting
read_file_2 = ReadFile(File="C:\Users\77777777\source\repos\machine_perception\demo4.1_tracking\opt\data\m.txt", PerLineParse=True)

# ---- group: target
read_file_3 = ReadFile(File="C:\Users\77777777\source\repos\machine_perception\demo4.1_tracking\opt\data\t.txt", PerLineParse=True)

# ----
read_file_4 = ReadFile(File="C:\Users\77777777\source\repos\machine_perception\demo4.1_tracking\opt\result.txt", PerLineParse=True)

# ---- group: get clinder param
curve = Curve(<curve referenced from the Rhino model>)
end_points = EndPoints(Curve=curve)  # -> Start, End
vector_2pt = Vector2Pt(PointA=end_points.Start, PointB=end_points.End, Unitize=True)  # -> Vector, Length
point = Point(end_points.Start)
ghpython_script = GhPythonScript(p=point, v=vector_2pt.Vector, r="9.36")  # -> out; inputs p: Point3d, v: Vector3d
# ---------- ghpython_script: Python ----------
print ("%f %f %f %f %f %f %f" % (p.X, p.Y, p.Z, v.X, v.Y, v.Z, r))
# ---------- end ghpython_script ----------
panel_2 = Panel(ghpython_script)

# ----
cluster = Cluster(str=read_file_4)
cylinder_reader = GhPythonScript(str=read_file_3)  # -> out, p
# ---------- cylinder_reader: Python ----------
import Rhino.Geometry as rg


nums = str.split(" ")

p = rg.Point3d(float(nums[0]), float(nums[1]), float(nums[2]))
# ---------- end cylinder_reader ----------
panel_3 = Panel(read_file)
visualize_cylinder = Visualize_cylinder(text=read_file)  # -> line, r
visualize_cylinder_2 = Visualize_cylinder(text=read_file_2)  # -> line, r
point_2 = Point(cylinder_reader.p)
transform = Transform(cluster)
pipe = Pipe(Curve=visualize_cylinder_2.line, Radius=visualize_cylinder_2.r, Caps=0)

create_material = CreateMaterial(
    Diffuse=ColourSwatch(SwatchColor=RGB(47, 0, 255)),
    Specular=RGB(255, 255, 255),
    Emission=RGB(0, 0, 0),
    Transparency=0.8,
    Shine=0)
custom_preview = CustomPreview(Geometry=[pipe, visualize_cylinder_2.line], Material=create_material)

transform_2 = Transform(Geometry=visualize_cylinder.line, Transform=transform)
pipe_2 = Pipe(Curve=transform_2, Radius=visualize_cylinder.r, Caps=0)

create_material_2 = CreateMaterial(
    Diffuse=ColourSwatch(SwatchColor=RGB(255, 178, 0)),
    Specular=RGB(255, 255, 255),
    Emission=RGB(0, 0, 0),
    Transparency=0.8,
    Shine=0)
custom_preview_2 = CustomPreview(Geometry=[pipe_2, transform_2], Material=create_material_2)

list_item = ListItem(List=transform_2, Index=0, Wrap=True)  # -> Item, Item1
custom_preview_3 = CustomPreview(Geometry=point_2, Material=ColourSwatch(SwatchColor=RGB(201, 107, 0)))
list_item_2 = ListItem(List=visualize_cylinder.r, Index=0, Wrap=True)  # -> Item, Item1
cluster_2 = Cluster_3(curve_2=[list_item.Item, list_item.Item1], curve=visualize_cylinder_2.line)  # -> point_2, point
number = Number([list_item_2.Item, list_item_2.Item1])
distance = Distance(PointA=cluster_2.point_2, PointB=cluster_2.point)
line = Line(StartPoint=cluster_2.point, EndPoint=cluster_2.point_2)
addition = Addition(A=number, B=visualize_cylinder_2.r)
subtraction = Subtraction(A=distance, B=addition)
ghpython_script_2 = GhPythonScript(x=subtraction)  # -> flatten(out)
# ---------- ghpython_script_2: Python ----------
print ("%.2f" % x)
# ---------- end ghpython_script_2 ----------

# ---- group: visulization
colour_swatch = ColourSwatch(SwatchColor=RGB(0, 0, 0))
curve_2 = Curve(line)
cluster_3 = Cluster_4(A_2=number, A=visualize_cylinder_2.r, curve=curve_2)
curve_middle = CurveMiddle(Curve=curve_2)
length = Length(Curve=curve_2)
custom_preview_4 = CustomPreview(Geometry=cluster_3, Material=colour_swatch)
unit_z = UnitZ(Factor=1)
construct_plane = ConstructPlane(Origin=curve_middle, XAxis=curve_2, YAxis=unit_z)
text_tag_3d = TextTag3D(Location=construct_plane, Text=ghpython_script_2, Size=6, Colour=colour_swatch, Justification=8)

# ----
panel_4 = Panel(ghpython_script_2)

# ==== cluster Visualize_cylinder
text = ClusterInput()
text_2 = Text(text)
cylinder_reader = GhPythonScript(str=text_2)  # -> out, r, p, v
# ---------- cylinder_reader: Python ----------
import Rhino.Geometry as rg


nums = str.split(" ")

p = rg.Point3d(float(nums[0]), float(nums[1]), float(nums[2]))
v = rg.Vector3d(float(nums[3]), float(nums[4]), float(nums[5]))
r = float(nums[6])
# ---------- end cylinder_reader ----------
unit_vector = UnitVector(Vector=cylinder_reader.v)
line_sdl = LineSDL(Start=cylinder_reader.p, Direction=unit_vector, Length="25")
line = ClusterOutput(line_sdl)
r = ClusterOutput(cylinder_reader.r)

# ==== cluster Cluster
str = ClusterInput()
cylinder_reader = GhPythonScript(str=str)  # -> out, v, t
# ---------- cylinder_reader: Python ----------
import Rhino.Geometry as rg


nums = str.split(" ")

v = rg.Vector3d(float(nums[0]), float(nums[1]), float(nums[2]))
t = rg.Vector3d(float(nums[3]), float(nums[4]), float(nums[5]))
# ---------- end cylinder_reader ----------
vector_length = VectorLength(Vector=cylinder_reader.v)
move = Move(Motion=cylinder_reader.t)  # -> Geometry, Transform
rotate_3d = Rotate3D(Angle=vector_length, Center=Point(0, 0, 0), Axis=cylinder_reader.v)  # -> Geometry, Transform
compound = Compound(Transforms=[rotate_3d.Transform, move.Transform])
compound_2 = ClusterOutput(compound)

# ==== cluster Cluster_3
curve = ClusterInput()
curve_2 = ClusterInput()
curve_3 = Curve(curve)
curve_4 = Curve(curve_2)
cluster = Cluster_2(curve=curve_3, curve_2=curve_4)
cluster_2 = Cluster_2(curve=curve_4, curve_2=curve_3)
point = ClusterOutput(cluster)
point_2 = ClusterOutput(cluster_2)

# ==== cluster Cluster_4
A = ClusterInput()
A_2 = ClusterInput()
curve = ClusterInput()
curve_2 = Curve(curve)
length = Length(Curve=curve_2)
division = Division(A=A_2, B=length)
division_2 = Division(A=A, B=length)
construct_domain = ConstructDomain(DomainStart=division, DomainEnd=expr("1-x", division_2))
sub_curve = SubCurve(BaseCurve=curve_2, Domain=construct_domain)
curve_3 = ClusterOutput(sub_curve)

# ==== cluster Cluster_2
curve = ClusterInput()
curve_2 = ClusterInput()
curve_3 = Curve(curve)
curve_4 = Curve(curve_2)
cross_product = CrossProduct(VectorA=curve_3, VectorB=curve_4, Unitize=False)  # -> Vector, Length
end_points = EndPoints(Curve=curve_3)  # -> Start, End
line_sdl = LineSDL(Start=end_points.Start, Direction=cross_product.Vector, Length=1)
line_line = LineLine(LineA=curve_3, LineB=line_sdl)
line_plane = LinePlane(Line=curve_4, Plane=line_line)  # -> Point, ParamL, ParamP
point = ClusterOutput(line_plane.Point)
