# Grasshopper definition get_cylinder_param.gh (Grasshopper 1.0.7)
# plug-ins: Human

panel = Panel("C2_E")
panel_2 = Panel("C1_C")
panel_3 = Panel("C1_V2")
panel_4 = Panel("C2_C")
panel_5 = Panel("C1_V")
panel_6 = Panel("C2_V")

# ---- group: get_cylinder_params
curve = Curve([<curve referenced from the Rhino model> x2])
vector = Vector(expr("-x", Vector(15, 15.00000473, 5)))
move = Move(Geometry=curve, Motion=vector)  # -> Geometry, Transform
end_points = EndPoints(Curve=move.Geometry)  # -> Start, End
vector_2pt = Vector2Pt(PointA=end_points.Start, PointB=end_points.End, Unitize=True)  # -> Vector, Length
R = Panel("10.0")
panel_7 = Panel(end_points.Start)
panel_8 = Panel(vector_2pt.Vector)
ghpython_script = GhPythonScript(p=end_points.Start, v=vector_2pt.Vector, r=R)  # -> out; inputs p: list of Point3d, v: list of Vector3d
# ---------- ghpython_script: Python ----------
for i in range(len(p)):
    print str(r)+" "+str(p[i].X)+" "+str(p[i].Y)+" "+str(p[i].Z)+" "+str(v[i].X)+" "+str(v[i].Y)+" "+str(v[i].Z)
# ---------- end ghpython_script ----------
panel_9 = Panel(ghpython_script)

# ----
vector_xyz = VectorXYZ(XComponent="2", YComponent="-4", ZComponent="10")  # -> Vector, Length
c2_c = Point([Point(154.960652, 165.9616953, 37.976465), Point(152.744221, 164.7968753, 37.408475), Point(154.671979, 164.3418053, 37.560564), Point(156.45874, 163.5138353, 38.351743), Point(153.538968, 162.8511653, 37.814226), Point(164.9545, 163.8740153, 38.488683)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])
c2_c_2 = Point([Point(160.64978, 167.9046253, 44.754964), Point(161.11149, 166.5872453, 44.88941), Point(163.90791, 166.4326253, 44.67378), Point(163.58721, 167.7033453, 41.694219), Point(164.55739, 166.8970753, 42.125486), Point(164.19027, 164.2439253, 45.132913)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])
c2_c_3 = Point([Point(208.65951, 173.1673953, 9.407411), Point(212.0166, 169.9455553, 13.946273), Point(230.48932, 162.3205953, 21.654146), Point(234.28495, 161.1581853, 20.290802), Point(270.04557, 169.3421153, 9.830695), Point(237.22516, 158.0578853, 21.230423)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])
c2_c_4 = Point([Point(183.45746, 183.0956053, 38.10577226), Point(178.5425, 182.3292153, 37.17303326), Point(180.19067, 181.7614053, 37.18151726), Point(182.98681, 181.0720153, 37.46774926), Point(184.00943, 180.6311453, 37.20175026), Point(185.06486, 180.1466053, 37.02631626)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])
c2_c_5 = Point([Point(157.95618, 168.7690553, 45.571088), Point(158.34374, 167.5161853, 45.577028), Point(161.26011, 167.2153153, 45.56278), Point(163.64247, 166.8347553, 45.577119), Point(164.65243, 166.6408053, 45.072408), Point(164.88778, 165.9662453, 45.158582)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])
c2_v = Point([Point(182.7061, 182.5470553, 39.79714772), Point(178.52294, 179.6184053, 43.89095472), Point(178.72355, 178.8593853, 44.34483172), Point(175.56332, 179.0356253, 42.64796272), Point(187.28975, 177.3362553, 46.57680772), Point(184.08146, 176.9636753, 46.14067272)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])

# ---- group: plot_data
file_path = FilePath("E:\scan_data\demo20200624\data3D\cloud_passthrough.pcd")
cloud_reader = GhPythonScript(path=file_path)  # -> out, pc
# ---------- cloud_reader: Python ----------
import Rhino.Geometry as rg
import Grasshopper as gh


def is_number(n):
    is_number = True
    try:
        num = float(n)
        # 检查 "nan" 
        is_number = num == num   # 或者使用 `math.isnan(num)`
    except ValueError:
        is_number = False
    return is_number


f = open(path,'r')
count = 0
dropoutCount = -1
pc = gh.DataTree[rg.Point3d]()

try:
    lines = f.readlines()
    for line in lines:
        dropoutCount += 1;
        if dropoutCount % 20 != 0:
            continue
        if count % 180 == 0:
            pth = gh.Kernel.Data.GH_Path(count/180)
        
        if not is_number(line[0:2]):
            continue
        nums = line.split(" ")
        x = float(nums[0].replace(",", "."))
        y = float(nums[1].replace(",", "."))
        z = float(nums[2].replace(",", "."))
        
        pc.Add(rg.Point3d(x, y, z), pth)
        count += 1
finally:
    f.close()
    
print count
# ---------- end cloud_reader ----------
vector_2 = Vector(Vector(15, 15.00000473, 5))
point = Point(flatten(cloud_reader.pc))
move_2 = Move(Geometry=point, Motion=vector_2)  # -> Geometry, Transform
curve_2 = Curve(<curve referenced from the Rhino model>)
colour_swatch = ColourSwatch(SwatchColor=RGB(2, 94, 0))
colour_swatch_2 = ColourSwatch(SwatchColor=RGB(230, 230, 0))
colour_swatch_3 = ColourSwatch(SwatchColor=RGB(207, 0, 0))
series = Series(Start=0, Step=expr("1.0/x", "10"), Count=expr("x+1", "10"))
ghpython_script_2 = GhPythonScript(n="10")  # -> out; inputs n: Int32
# ---------- ghpython_script_2: Python ----------
for i in range(n+1):
    if i == 0:
        print "0"
    elif i == n:
        print "43mm"
    else:
        print ""
# ---------- end ghpython_script_2 ----------
gradient = Gradient(LowerLimit=0, UpperLimit=1, Parameter=series, stops=[0: RGB(0, 128, 0), 0.5: RGB(230, 230, 0), 1: RGB(255, 0, 0)])
legend = Legend(
    Colour=gradient,
    Tags=ghpython_script_2,
    Rectangle={Plane=PlaneXY(737.9370994, -88.97244704, 0), Size=Domain2(u=-14.39113575..14.39113575, v=-46.30191502..46.30191502)},
    LegendType=101)

# ----
panel_10 = Panel(file_path)
addition = Addition(A=vector_2, B=vector_xyz.Vector)
point_2 = Point(move_2.Geometry)

# ---- group: plot_data (continued)
curve_closest_point = CurveClosestPoint(Point=graft(point_2), Curve=curve_2)  # -> Point, Parameter, Distance
subtraction = Subtraction(A=curve_closest_point.Distance, B="9.45")
absolute = Absolute(Value=subtraction)
sort_list = SortList(Keys=absolute)  # -> Keys, ValuesValuesA
list_item = ListItem(List=sort_list.Keys, Index=0, Wrap=True)  # -> flatten(Item)
sort_list_2 = SortList(Keys=list_item)  # -> Keys, ValuesValuesA
list_item_2 = ListItem(List=sort_list_2.Keys, Index=0, Wrap=True)  # -> Item1, Item
panel_11 = Panel(list_item_2.Item1)
subtraction_2 = Subtraction(A=list_item_2.Item1, B=list_item_2.Item)
subtraction_3 = Subtraction(A=list_item, B=list_item_2.Item)
division = Division(A=subtraction_3, B=subtraction_2)
point_3 = Point(point_2)

# ----
panel_12 = Panel(list_item)
division_2 = Division(A=list_item, B="6")
gradient_2 = Gradient(LowerLimit=0, UpperLimit=1, Parameter=division_2, stops=[0: RGB(0, 42, 255), 0: RGB(144, 255, 0), 1: RGB(255, 0, 0)])

# ---- group: plot_data (continued)
gradient_3 = Gradient(LowerLimit=0, UpperLimit=1, Parameter=division_2, stops=[0: RGB(0, 128, 0), 0.5: RGB(230, 230, 0), 1: RGB(255, 0, 0)])
createattributes = CreateAttributes(LayerName="pc2", Color=gradient_2, enableFullPath=False)
bake_geometry = BakeGeometry(Bake=Toggle(False), Geometry=point_3, Attributes=createattributes, DeleteOldBakes=False, PreserveTrees=False)
