# Grasshopper definition connector.gh (Grasshopper 1.0.7)

line = Line(Line((-8109.027778, 1134.880642, 2357.328164), (-7731.371552, 1337.536371, 1966.16938)))
line_2 = Line(Line((-8109.027778, 1134.880642, 2357.328164), (-8800, 2143.2324, 2571.890355)))
line_3 = Line(Line((-8109.027778, 1134.880642, 2357.328164), (-7522.222222, 2143.2324, 2639.943636)))
line_4 = Line(Line((-8109.027778, 1134.880642, 2357.328164), (-7018.75, 1134.880642, 2555.274614)))
line_5 = Line(Line((-8109.027778, 1134.880642, 2357.328164), (-7522.222222, 0, 2578.703704)))
line_6 = Line(Line((-8109.027778, 1134.880642, 2357.328164), (-8800, 0, 2500)))
line_7 = Line(Line((-8109.027778, 1134.880642, 2357.328164), (-8800, 1140.97999, 2331.860176)))
end_points = EndPoints(Curve=line)  # -> Start, End
line_8 = Line([line_2, line_3, line_4, line_5, line_6, line_7])
point = Point(end_points.Start)

# ---- group: common normal
normal = Normal(vector=line_8)

# ---- group: bisector
cluster = Cluster(vector=line_8)

# ----
vector = Vector(cluster)
plane_normal = PlaneNormal(Origin=point, ZAxis=normal)
multiplication = Multiplication(A=vector, B="40")
addition = Addition(A=point, B=multiplication)

# ---- group: face normal
cluster_2 = Cluster_2(point_a=addition, line=line_8)

# ----
plane = Plane(cluster_2)
plane_offset = PlaneOffset(BasePlane=plane, Offset="-10")
plane_offset_2 = PlaneOffset(BasePlane=plane, Offset="-20")
circle = Circle(Plane=plane, Radius="10")  # -> graft(Circle)
deconstruct_plane = DeconstructPlane(Plane=plane_offset)  # -> Origin, XAxis, YAxis, ZAxis
deconstruct_plane_2 = DeconstructPlane(Plane=plane_offset_2)  # -> Origin, XAxis, YAxis, ZAxis
circle_2 = Circle(Plane=plane_normal, Radius="40")
plane_offset_3 = PlaneOffset(BasePlane=plane_normal, Offset="-20")
cross_product = CrossProduct(VectorA=normal, VectorB=deconstruct_plane_2.XAxis, Unitize=False)  # -> expr("x", Vector), Length
line_9 = Line(StartPoint=deconstruct_plane_2.Origin, EndPoint=plane_offset_3)
construct_plane = ConstructPlane(Origin=deconstruct_plane.Origin, XAxis=line_9, YAxis=cross_product.Vector)
construct_plane_2 = ConstructPlane(Origin=deconstruct_plane_2.Origin, XAxis=line_9, YAxis=cross_product.Vector)
circle_3 = Circle(Plane=construct_plane, Radius="5")  # -> graft(Circle)
circle_4 = Circle(Plane=construct_plane_2, Radius="5")  # -> graft(Circle)
list_item = ListItem(List=construct_plane_2, Index=2, Wrap=True)
loft = Loft(
    Curves=[circle, circle_3, circle_4],
    Options={Adjust=False, Closed=False, LoftEnds=0, LoftSimp=0, LoftType=0, Rebuild=10, Refit=0.01})
brep = Brep(<brep referenced from the Rhino model>)
orient = Orient(Geometry=brep, Source=list_item, Target=construct_plane_2)  # -> Geometry, Transform

# ==== cluster Normal
vector = ClusterInput()
vector_2 = Vector(vector)
shift_list = ShiftList(List=vector_2, Shift=1, Wrap=True)
cross_product = CrossProduct(VectorA=vector_2, VectorB=shift_list, Unitize=False)  # -> expr("x * 0.01", Vector), Length
mass_addition = MassAddition(Input=cross_product.Vector)  # -> Result, PartialResults
unit_vector = UnitVector(Vector=mass_addition.Result)  # -> expr("-x", Vector)
vector_3 = ClusterOutput(unit_vector)

# ==== cluster Cluster
vector = ClusterInput()
vector_2 = Vector(unitize(vector))
shift_list = ShiftList(List=vector_2, Shift=1, Wrap=True)
addition = Addition(A=vector_2, B=shift_list)
unit_vector = UnitVector(Vector=addition)
vector_3 = ClusterOutput(unit_vector)

# ==== cluster Cluster_2
line = ClusterInput()
line_2 = Line(line)
shift_list = ShiftList(List=line_2, Shift=1, Wrap=True)
end_points = EndPoints(Curve=line_2)  # -> Start, End
end_points_2 = EndPoints(Curve=shift_list)  # -> Start, End
point_a = ClusterInput()
plane_3pt = Plane3Pt(PointA=point_a, PointB=end_points.Start, PointC=end_points_2.End)
plane = ClusterOutput(plane_3pt)
