# Grasshopper definition adaption.gh (Grasshopper 1.0.7)

file_path = FilePath("E:\scan_data\tree_2\pole_1\data3D\result_2.txt")
file_path_2 = FilePath("E:\scan_data\tree_2\pole_1\data3D\cloud_passthrough_2.pcd")
cluster = Cluster(path=file_path_2, path_2=file_path, x_coordinate="251.449", x_coordinate_2="301.449")  # -> r, geometry, line_2
pipe = Pipe(Curve=cluster.line_2, Radius=cluster.r, Caps=1)
point = Point(cluster.geometry)

file_path_3 = FilePath("E:\scan_data\tree_2\pole_1\data3D\result_1.txt")
file_path_4 = FilePath("E:\scan_data\tree_2\pole_1\data3D\cloud_passthrough_1.pcd")
cluster_2 = Cluster(path=file_path_4, path_2=file_path_3, x_coordinate="119.23", x_coordinate_2="169.23")  # -> r, geometry, line_2
pipe_2 = Pipe(Curve=cluster_2.line_2, Radius=cluster_2.r, Caps=1)
point_2 = Point(cluster_2.geometry)

file_path_5 = FilePath("C:\Users\77777777\source\repos\machine_perception\demo4.1_tracking\physical_setup_tree\hide\tree_2\pole_1\result_0.txt")
file_path_6 = FilePath("C:\Users\77777777\source\repos\machine_perception\demo4.1_tracking\physical_setup_tree\hide\tree_2\pole_1\cloud_passthrough_0.pcd")
cluster_3 = Cluster(path=file_path_6, path_2=file_path_5, x_coordinate="13.474", x_coordinate_2="63.474")  # -> r, geometry, line_2
pipe_3 = Pipe(Curve=cluster_3.line_2, Radius=cluster_3.r, Caps=1)
point_3 = Point(cluster_3.geometry)

# ---- group: new_pole_1
panel = Panel("0")
curve = Curve(<curve referenced from the Rhino model>)
file_path_7 = FilePath("C:\Users\77777777\source\repos\machine_perception\demo4.1_tracking\physical_setup_tree\hide\tree_2\pole_1\result_0.txt")
file_path_8 = FilePath("C:\Users\77777777\source\repos\machine_perception\demo4.1_tracking\physical_setup_tree\hide\tree_2\pole_1\cloud_passthrough_0.pcd")
cluster_4 = Cluster(path=file_path_8, path_2=file_path_7, x_coordinate="13.474", x_coordinate_2="63.474")  # -> r, geometry, line_2
pipe_4 = Pipe(Curve=cluster_4.line_2, Radius=cluster_4.r, Caps=1)
point_4 = Point(cluster_4.geometry)

# ---- group: new_pole_2
panel_2 = Panel("35 / 180.0 * Pi")
curve_2 = Curve(curve)
file_path_9 = FilePath("C:\Users\77777777\source\repos\machine_perception\demo3.1_validate_in_process_scan\physical_setup\scaned_data_2\pole_3\theta_2.txt")
file_path_10 = FilePath("C:\Users\77777777\source\repos\machine_perception\demo3.1_validate_in_process_scan\physical_setup\scaned_data_2\pole_3\cloud_passthrough_2.pcd")
cluster_5 = Cluster(path=file_path_10, path_2=file_path_9, x_coordinate="190", x_coordinate_2="270")  # -> r, geometry, line_2
point_5 = Point(cluster_5.geometry)
pipe_5 = Pipe(Curve=cluster_5.line_2, Radius=cluster_5.r, Caps=1)

# ---- group: built
curve_3 = Curve(reparameterize(<curve referenced from the Rhino model>))
vector = Vector(Vector(0, 0, 0))
file_path_11 = FilePath("C:\Users\77777777\source\repos\machine_perception\demo4.1_tracking\physical_setup_tree\hide\tree_2\built_1\cloud_passthrough_0.pcd")
file_path_12 = FilePath("C:\Users\77777777\source\repos\machine_perception\demo4.1_tracking\physical_setup_tree\hide\tree_2\built_1\result_0.txt")
cluster_6 = Cluster_2(
    path_2=file_path_11,
    vector=vector,
    path=file_path_12,
    curve=curve_3,
    parameter_2="191.437 / 300.0",
    parameter="241.437 / 300.0")  # -> geometry, r, line_2
pipe_6 = Pipe(Curve=cluster_6.line_2, Radius=cluster_6.r, Caps=1)
point_6 = Point(cluster_6.geometry)

# ----
distance_between_lines = Panel("-28.0")

# ----
# optimization
panel_3 = Panel("5")
number_slider = Slider(0, range=0..2)
number_slider_2 = Slider(0.852, range=0..2)
construct_point = ConstructPoint(XCoordinate="10", YCoordinate=panel_3, ZCoordinate=0)
multiplication = Multiplication(A=number_slider_2, B="pi")
unit_x = UnitX(Factor=1)
rotate = Rotate(Geometry=unit_x, Angle=multiplication, Plane=PlaneXY(0, 0, 0))  # -> Geometry, Transform
unit_z = UnitZ(Factor=1)
circle = Circle(Plane=construct_point, Radius="2")
line_sdl = LineSDL(Start=construct_point, Direction=rotate.Geometry, Length=number_slider)
cross_product = CrossProduct(VectorA=rotate.Geometry, VectorB=unit_z, Unitize=True)  # -> Vector, Length
end_points = EndPoints(Curve=line_sdl)  # -> Start, End
multiplication_2 = Multiplication(A=cross_product.Vector, B="4")
move = Move(Geometry=end_points.End, Motion=expr("-x", multiplication_2))  # -> Geometry, Transform
move_2 = Move(Geometry=end_points.End, Motion=multiplication_2)  # -> Geometry, Transform
deconstruct = Deconstruct(Point=move_2.Geometry)  # -> XComponent, YComponent, ZComponent
deconstruct_2 = Deconstruct(Point=move.Geometry)  # -> XComponent, YComponent, ZComponent
multiplication_3 = Multiplication(A=deconstruct.XComponent, B=deconstruct.YComponent)
multiplication_4 = Multiplication(A=deconstruct_2.XComponent, B=deconstruct_2.YComponent)
subtraction = Subtraction(A=multiplication_3, B=multiplication_4)
panel_4 = Panel(subtraction)
galapagos = Galapagos(fitness=subtraction, gene=[number_slider, number_slider_2])

curve_4 = Curve(cluster_6.line_2)
curve_5 = Curve(cluster_4.line_2)
curve_6 = Curve(cluster_5.line_2)

# ---- group: scaned_holes
file_path_13 = FilePath("C:\Users\77777777\source\repos\machine_perception\demo3.1_validate_in_process_scan\physical_setup\scaned_data_2\built_2\circle_0.pcd")
file_path_14 = FilePath("C:\Users\77777777\source\repos\machine_perception\demo3.1_validate_in_process_scan\physical_setup\scaned_data_2\built_2\circle_1.pcd")
cloud_reader = GhPythonScript(path=file_path_13)  # -> out, pc
# ---------- cloud_reader: Python ----------
import Rhino.Geometry as rg
import Grasshopper as gh


def is_number(n):
    is_number = True
    try:
        num = float(n)
        # 检查 "nan" 
        is_number = num == num   # 或者使用 `math.isnan(num)`
    except ValueError:
        is_number = False
    return is_number


f = open(path,'r')
count = 0
dropoutCount = -1
pc = gh.DataTree[rg.Point3d]()

try:
    lines = f.readlines()
    for line in lines:
        dropoutCount += 1;
#        if dropoutCount % 2 != 0:
#            continue
        if count % 180 == 0:
            pth = gh.Kernel.Data.GH_Path(count/180)
        
        if not is_number(line[0:2]):
            continue
        nums = line.split(" ")
        x = float(nums[0].replace(",", "."))
        y = float(nums[1].replace(",", "."))
        z = float(nums[2].replace(",", "."))
        
        pc.Add(rg.Point3d(x, y, z), pth)
        count += 1
finally:
    f.close()
    
print count
# ---------- end cloud_reader ----------
cloud_reader_2 = GhPythonScript(path=file_path_14)  # -> out, pc
# ---------- cloud_reader_2: Python ----------
import Rhino.Geometry as rg
import Grasshopper as gh


def is_number(n):
    is_number = True
    try:
        num = float(n)
        # 检查 "nan" 
        is_number = num == num   # 或者使用 `math.isnan(num)`
    except ValueError:
        is_number = False
    return is_number


f = open(path,'r')
count = 0
dropoutCount = -1
pc = gh.DataTree[rg.Point3d]()

try:
    lines = f.readlines()
    for line in lines:
        dropoutCount += 1;
        if dropoutCount % 2 != 0:
            continue
        if count % 180 == 0:
            pth = gh.Kernel.Data.GH_Path(count/180)
        
        if not is_number(line[0:2]):
            continue
        nums = line.split(" ")
        x = float(nums[0].replace(",", "."))
        y = float(nums[1].replace(",", "."))
        z = float(nums[2].replace(",", "."))
        
        pc.Add(rg.Point3d(x, y, z), pth)
        count += 1
finally:
    f.close()
    
print count
# ---------- end cloud_reader_2 ----------
point_7 = Point(flatten(cloud_reader.pc))
point_8 = Point(flatten(cloud_reader_2.pc))
move_3 = Move(Geometry=point_7, Motion=vector)  # -> Geometry, Transform
move_4 = Move(Geometry=point_8, Motion=vector)  # -> Geometry, Transform

# ----
cluster_7 = Cluster_9(point=move_4.Geometry, curve=cluster_6.line_2)
cluster_8 = Cluster_9(point=move_3.Geometry, curve=cluster_6.line_2)

# ---- group: scaned_holes (continued)
cluster_9 = Cluster_3(vertices=cluster_8)
cluster_10 = Cluster_3(vertices=cluster_7)
curve_closest_point = CurveClosestPoint(Point=cluster_9, Curve=cluster_6.line_2)  # -> Point, Parameter, Distance
curve_closest_point_2 = CurveClosestPoint(Point=cluster_10, Curve=cluster_6.line_2)  # -> Point, Parameter, Distance
cluster_11 = Cluster_4(point=curve_closest_point.Point, A="28 / 2.0", B=curve_closest_point_2.Point)  # -> geometry_2, geometry
cluster_12 = Cluster_5(
    point_3=cluster_9,
    point_4=cluster_11.geometry_2,
    point=cluster_10,
    point_2=cluster_11.geometry,
    B=distance_between_lines)  # -> geometry, geometry_3, geometry_2, result

# ---- group: optimization
rotation = GenePool(Decimals=6, Maximum=3.14, Minimum=-3.14, Value=[-0.10914, -0.02702, -0.02352])
translation = GenePool(Decimals=6, Maximum=50, Minimum=-50, Value=[-11.91691, 6.55345, 5.90026])
list_item = ListItem(List=translation, Index=0, Wrap=True)  # -> Item, Item1, Item2
list_item_2 = ListItem(List=rotation, Index=0, Wrap=True)  # -> Item, Item1, Item2
vector_xyz = VectorXYZ(XComponent=list_item.Item, YComponent=list_item.Item1, ZComponent=list_item.Item2)  # -> Vector, Length
vector_xyz_2 = VectorXYZ(XComponent=list_item_2.Item, YComponent=list_item_2.Item1, ZComponent=list_item_2.Item2)  # -> Vector, Length
key_point_param = Panel("234.0 / 300")
curve_7 = Curve(curve)
point_9 = Point(cluster_12.geometry_2)
move_5 = Move(Geometry=curve_5, Motion=vector_xyz.Vector)  # -> Geometry, Transform
move_6 = Move(Geometry=curve_6, Motion=vector_xyz.Vector)  # -> Geometry, Transform
evaluate_curve = EvaluateCurve(Curve=reparameterize(curve_7), Parameter=key_point_param)  # -> Point, Tangent, Angle
move_7 = Move(Geometry=curve_7, Motion=vector_xyz.Vector)  # -> Geometry, Transform
rotate_3d = Rotate3D(Geometry=move_5.Geometry, Angle=vector_xyz_2.Length, Center=Point(0, 0, 0), Axis=vector_xyz_2.Vector)  # -> Geometry, Transform
rotate_3d_2 = Rotate3D(Geometry=move_6.Geometry, Angle=vector_xyz_2.Length, Center=Point(0, 0, 0), Axis=vector_xyz_2.Vector)  # -> Geometry, Transform
rotate_3d_3 = Rotate3D(Geometry=move_7.Geometry, Angle=vector_xyz_2.Length, Center=Point(0, 0, 0), Axis=vector_xyz_2.Vector)  # -> Geometry, Transform
key_point_param_2 = Panel("27.0 / 80")
evaluate_curve_2 = EvaluateCurve(Curve=reparameterize(rotate_3d.Geometry), Parameter=key_point_param_2)  # -> Point, Tangent, Angle
distance = Distance(PointA=evaluate_curve_2.Point, PointB=point_9)
curve_closest_point_3 = CurveClosestPoint(Point=evaluate_curve.Point, Curve=rotate_3d_2.Geometry)  # -> Point, Parameter, Distance
galapagos_2 = Galapagos(fitness=addition, gene=[translation, rotation])
addition = Addition(A=distance, B=curve_closest_point_3.Distance)

# ---- group: optimized result
curve_8 = Curve(rotate_3d_2.Geometry)
curve_9 = Curve(rotate_3d.Geometry)
curve_10 = Curve(rotate_3d_3.Geometry)

# ---- group: connector
curve_11 = Curve(curve_4)
curve_12 = Curve(curve_9)
cluster_13 = Cluster_6(curve=curve_11, curve_2=curve_12)
cluster_14 = Cluster_6(curve=curve_12, curve_2=curve_11)
vector_2pt = Vector2Pt(PointA=cluster_14, PointB=cluster_13, Unitize=True)  # -> Vector, Length
vector_2 = Vector(cluster_12.result)
cluster_15 = Cluster_7(origin=cluster_14, x_axis=curve_11, vector_b=vector_2, number_2="54", number="20")
cluster_16 = Cluster_7(origin=cluster_13, x_axis=curve_12, vector_b=vector_2pt.Vector, number_2="54", number="20")
multiplication_5 = Multiplication(A=vector_2pt.Vector, B="5")
move_8 = Move(Geometry=cluster_15, Motion=multiplication_5)  # -> Geometry, Transform
move_9 = Move(Geometry=cluster_16, Motion=expr("-x", multiplication_5))  # -> Geometry, Transform
cluster_17 = Cluster_8(curve=move_8.Geometry, curve_2=move_9.Geometry, shift="-1")
brep = Brep(cluster_17)
cap_holes = CapHoles(Brep=brep)

# ---- group: arduino_orientation
unit_vector = UnitVector(Vector=expr("-x", vector_2pt.Vector))
unit_z_2 = UnitZ(Factor=1)
cross_product_2 = CrossProduct(VectorA=unit_vector, VectorB=unit_z_2, Unitize=False)  # -> Vector, Length
dot_product = DotProduct(VectorA=cross_product_2.Vector, VectorB=curve_10, Unitize=True)
arcsine = ArcSine(Value=cross_product_2.Length)
ghpython_script = GhPythonScript(x=dot_product)  # -> out, a
# ---------- ghpython_script: Python ----------
if x < 0.0:
    a = -1.0
else:
    a = 1.0
# ---------- end ghpython_script ----------
degrees = Degrees(Radians=arcsine)
multiplication_6 = Multiplication(A=degrees, B=ghpython_script.a)
panel_5 = Panel(multiplication_6)

# ---- group: arduino_position
key_point_param_3 = Panel("40.0 / 80")
key_point_param_4 = Panel("27.0 / 80")
evaluate_curve_3 = EvaluateCurve(Curve=reparameterize(curve_9), Parameter=key_point_param_4)  # -> Point, Tangent, Angle
evaluate_curve_4 = EvaluateCurve(Curve=reparameterize(curve_8), Parameter=key_point_param_3)  # -> Point, Tangent, Angle
curve_closest_point_4 = CurveClosestPoint(Point=evaluate_curve_3.Point, Curve=reparameterize(curve_10))  # -> Point, Parameter, Distance
key_point_param_5 = Panel("300.0")
curve_closest_point_5 = CurveClosestPoint(Point=evaluate_curve_4.Point, Curve=reparameterize(curve_10))  # -> Point, Parameter, Distance
multiplication_7 = Multiplication(A=[curve_closest_point_4.Parameter, curve_closest_point_5.Parameter], B=key_point_param_5)
key_point_param_6 = Panel(multiplication_7)

# ---- group: holes
move_10 = Move(Geometry=cluster_13, Motion=expr("-x*14", curve_12))  # -> Geometry, Transform
move_11 = Move(Geometry=cluster_13, Motion=expr("x*14", curve_12))  # -> Geometry, Transform
line_sdl_2 = LineSDL(Start=flatten([move_11.Geometry, move_10.Geometry]), Direction=vector_2pt.Vector, Length=300)
move_12 = Move(Geometry=line_sdl_2, Motion=expr("-0.5*x", line_sdl_2))  # -> Geometry, Transform
pipe_7 = Pipe(Curve=curve_9, Radius=cluster_4.r, Caps=1)
pipe_8 = Pipe(Curve=cluster_6.line_2, Radius=cluster_6.r, Caps=1)
pipe_9 = Pipe(Curve=[cluster_12.geometry, cluster_12.geometry_3, move_12.Geometry], Radius="1.65", Caps=1)  # -> flatten(Pipe)

# ----
solid_difference = SolidDifference(BrepsA=cap_holes, BrepsB=flatten([pipe_7, pipe_8, pipe_9]))

# ==== cluster Cluster
x_coordinate = ClusterInput()
x_coordinate_2 = ClusterInput()
construct_point = ConstructPoint(XCoordinate=x_coordinate_2, YCoordinate=0, ZCoordinate=0)
construct_point_2 = ConstructPoint(XCoordinate=x_coordinate, YCoordinate=0, ZCoordinate=0)
path = ClusterInput()
path_2 = ClusterInput()
vector = Vector(Vector(983.428576, 58.2433138, 4))
cloud_reader = GhPythonScript(path=path)  # -> out, pc
# ---------- cloud_reader: Python ----------
import Rhino.Geometry as rg
import Grasshopper as gh


def is_number(n):
    is_number = True
    try:
        num = float(n)
        # 检查 "nan" 
        is_number = num == num   # 或者使用 `math.isnan(num)`
    except ValueError:
        is_number = False
    return is_number


f = open(path,'r')
count = 0
dropoutCount = -1
pc = gh.DataTree[rg.Point3d]()

try:
    lines = f.readlines()
    for line in lines:
        dropoutCount += 1;
        if dropoutCount % 60 != 0:
            continue
        if count % 180 == 0:
            pth = gh.Kernel.Data.GH_Path(count/180)
        
        if not is_number(line[0:2]):
            continue
        nums = line.split(" ")
        x = float(nums[0].replace(",", "."))
        y = float(nums[1].replace(",", "."))
        z = float(nums[2].replace(",", "."))
        
        pc.Add(rg.Point3d(x, y, z), pth)
        count += 1
finally:
    f.close()
    
print count
# ---------- end cloud_reader ----------
cylinder_reader = GhPythonScript(path=path_2)  # -> out, r, p, v
# ---------- cylinder_reader: Python ----------
import Rhino.Geometry as rg

f = open(path,'r')

try:
    line = f.readlines()
    nums = line[0].split(" ")
    r = float(nums[0])
    p = rg.Point3d(float(nums[1]), float(nums[2]), float(nums[3]))
    v = rg.Vector3d(float(nums[4]), float(nums[5]), float(nums[6]))
finally:
    f.close()
# ---------- end cylinder_reader ----------
move = Move(Geometry=construct_point_2, Motion=vector)  # -> Geometry, Transform
move_2 = Move(Geometry=construct_point, Motion=vector)  # -> Geometry, Transform
r = ClusterOutput(cylinder_reader.r)
point = Point(flatten(cloud_reader.pc))
vector_2 = Vector(expr("x", Vector(1003.428576, -19.30705661, 4)))
move_3 = Move(Geometry=point, Motion=vector_2)  # -> Geometry, Transform
move_4 = Move(Geometry=cylinder_reader.p, Motion=vector_2)  # -> Geometry, Transform
yz_plane = YZPlane(Origin=move.Geometry)
yz_plane_2 = YZPlane(Origin=move_2.Geometry)
line_sdl = LineSDL(Start=move_4.Geometry, Direction=cylinder_reader.v, Length="10")
line_plane = LinePlane(Line=line_sdl, Plane=yz_plane)  # -> Point, ParamL, ParamP
line_plane_2 = LinePlane(Line=line_sdl, Plane=yz_plane_2)  # -> Point, ParamL, ParamP
line = Line(StartPoint=line_plane.Point, EndPoint=line_plane_2.Point)
geometry = ClusterOutput(move_3.Geometry)
line_2 = ClusterOutput(line)

# ==== cluster Cluster_2
path = ClusterInput()
curve = ClusterInput()
path_2 = ClusterInput()
vector = ClusterInput()
cylinder_reader = GhPythonScript(path=path)  # -> out, r, p, v; same code as cylinder_reader
curve_2 = Curve(curve)
cloud_reader = GhPythonScript(path=path_2)  # -> out, pc
# ---------- cloud_reader: Python ----------
import Rhino.Geometry as rg
import Grasshopper as gh


def is_number(n):
    is_number = True
    try:
        num = float(n)
        # 检查 "nan" 
        is_number = num == num   # 或者使用 `math.isnan(num)`
    except ValueError:
        is_number = False
    return is_number


f = open(path,'r')
count = 0
dropoutCount = -1
pc = gh.DataTree[rg.Point3d]()

try:
    lines = f.readlines()
    for line in lines:
        dropoutCount += 1;
        if dropoutCount % 20 != 0:
            continue
        if count % 180 == 0:
            pth = gh.Kernel.Data.GH_Path(count/180)
        
        if not is_number(line[0:2]):
            continue
        nums = line.split(" ")
        x = float(nums[0].replace(",", "."))
        y = float(nums[1].replace(",", "."))
        z = float(nums[2].replace(",", "."))
        
        pc.Add(rg.Point3d(x, y, z), pth)
        count += 1
finally:
    f.close()
    
print count
# ---------- end cloud_reader ----------
vector_2 = Vector(vector)
r = ClusterOutput(cylinder_reader.r)
point = Point(flatten(cloud_reader.pc))
parameter = ClusterInput()
parameter_2 = ClusterInput()
move = Move(Geometry=cylinder_reader.p, Motion=vector_2)  # -> Geometry, Transform
move_2 = Move(Geometry=point, Motion=vector_2)  # -> Geometry, Transform
evaluate_curve = EvaluateCurve(Curve=curve_2, Parameter=parameter)  # -> Point, Tangent, Angle
evaluate_curve_2 = EvaluateCurve(Curve=curve_2, Parameter=parameter_2)  # -> Point, Tangent, Angle
line_sdl = LineSDL(Start=move.Geometry, Direction=cylinder_reader.v, Length="10")
geometry = ClusterOutput(move_2.Geometry)
plane_normal = PlaneNormal(Origin=evaluate_curve_2.Point, ZAxis=evaluate_curve_2.Tangent)
plane_normal_2 = PlaneNormal(Origin=evaluate_curve.Point, ZAxis=evaluate_curve.Tangent)
line_plane = LinePlane(Line=line_sdl, Plane=plane_normal)  # -> Point, ParamL, ParamP
line_plane_2 = LinePlane(Line=line_sdl, Plane=plane_normal_2)  # -> Point, ParamL, ParamP
line = Line(StartPoint=line_plane.Point, EndPoint=line_plane_2.Point)
line_2 = ClusterOutput(line)

# ==== cluster Cluster_3
vertices = ClusterInput()
interpolate = Interpolate(Vertices=vertices, Degree=3, Periodic=False, KnotStyle=1)  # -> Curve, Length, Domain
rebuild_curve = RebuildCurve(Curve=interpolate.Curve, Degree=3, Count="5", Tangents=False)
patch = Patch(Curves=rebuild_curve, Spans=20, Flexibility=1, Trim=True)
area = Area(Geometry=patch)  # -> Area, Centroid
centroid = ClusterOutput(area.Centroid)

# ==== cluster Cluster_4
B = ClusterInput()
curve = ClusterInput()
point = ClusterInput()
point_2 = Point(point)
addition = Addition(A=point_2, B=B)
curve_2 = Curve(curve)
division = Division(A=addition, B=2)
vector_2pt = Vector2Pt(PointA=division, PointB=point_2, Unitize=True)  # -> Vector, Length
A = ClusterInput()
multiplication = Multiplication(A=A, B=vector_2pt.Vector)
move = Move(Geometry=division, Motion=expr("-x", multiplication))  # -> Geometry, Transform
move_2 = Move(Geometry=division, Motion=multiplication)  # -> Geometry, Transform
geometry = ClusterOutput(move.Geometry)
geometry_2 = ClusterOutput(move_2.Geometry)

# ==== cluster Cluster_5
point = ClusterInput()
point_2 = ClusterInput()
point_3 = ClusterInput()
point_4 = ClusterInput()
point_5 = Point(point)
point_6 = Point(point_2)
point_7 = Point(point_3)
point_8 = Point(point_4)
addition = Addition(A=point_8, B=point_6)
vector_2pt = Vector2Pt(PointA=point_5, PointB=point_6, Unitize=False)  # -> Vector, Length
vector_2pt_2 = Vector2Pt(PointA=point_7, PointB=point_8, Unitize=False)  # -> Vector, Length
point_9 = Point(expr("x*0.5", addition))
B = ClusterInput()
addition_2 = Addition(A=vector_2pt_2.Vector, B=vector_2pt.Vector)
unit_vector = UnitVector(Vector=expr("-x", addition_2))
multiplication = Multiplication(A=unit_vector, B=B)
line_sdl = LineSDL(Start=point_8, Direction=addition_2, Length="200")
line_sdl_2 = LineSDL(Start=point_6, Direction=addition_2, Length="200")
move = Move(Geometry=point_9, Motion=multiplication)  # -> Geometry, Transform
move_2 = Move(Geometry=line_sdl, Motion=expr("-0.5*x", line_sdl))  # -> Geometry, Transform
move_3 = Move(Geometry=line_sdl_2, Motion=expr("-0.5*x", line_sdl))  # -> Geometry, Transform
geometry = ClusterOutput(move_2.Geometry)
geometry_2 = ClusterOutput(move.Geometry)
result = ClusterOutput(addition_2)
geometry_3 = ClusterOutput(move_3.Geometry)

# ==== cluster Cluster_6
curve = ClusterInput()
curve_2 = ClusterInput()
curve_3 = Curve(curve)
curve_4 = Curve(curve_2)
cross_product = CrossProduct(VectorA=curve_3, VectorB=curve_4, Unitize=False)  # -> Vector, Length
end_points = EndPoints(Curve=curve_3)  # -> Start, End
line_sdl = LineSDL(Start=end_points.Start, Direction=cross_product.Vector, Length=1)
plane_3pt = Plane3Pt()
line_line = LineLine(LineA=curve_3, LineB=line_sdl)
line_plane = LinePlane(Line=curve_4, Plane=line_line)  # -> Point, ParamL, ParamP
point = ClusterOutput(line_plane.Point)

# ==== cluster Cluster_7
vector_b = ClusterInput()
number = ClusterInput()
number_2 = ClusterInput()
origin = ClusterInput()
x_axis = ClusterInput()
cross_product = CrossProduct(VectorA=x_axis, VectorB=vector_b, Unitize=True)  # -> Vector, Length
number_3 = Number(number)
number_4 = Number(number_2)
construct_domain = ConstructDomain(DomainStart=expr("-0.5*x", number_3), DomainEnd=expr("0.5*x", number_3))
construct_domain_2 = ConstructDomain(DomainStart=expr("-0.5*x", number_4), DomainEnd=expr("0.5*x", number_4))
construct_plane = ConstructPlane(Origin=origin, XAxis=x_axis, YAxis=cross_product.Vector)
rectangle = Rectangle(Plane=construct_plane, XSize=construct_domain_2, YSize=construct_domain, Radius=0)  # -> Rectangle, Length
rectangle_2 = ClusterOutput(rectangle.Rectangle)

# ==== cluster Cluster_8
curve = ClusterInput()
curve_2 = ClusterInput()
curve_3 = Curve(curve)
curve_4 = Curve(curve_2)
explode = Explode(Curve=curve_3, Recursive=True)  # -> Segments, Vertices
explode_2 = Explode(Curve=curve_4, Recursive=True)  # -> Segments, Vertices
shift = ClusterInput()
sub_list = SubList(List=explode.Vertices, Domain=Domain(0, 3), Wrap=True)  # -> List, Index
sub_list_2 = SubList(List=explode_2.Vertices, Domain=Domain(0, 3), Wrap=True)  # -> List, Index
shift_list = ShiftList(List=sub_list_2.List, Shift=shift, Wrap=True)
list_item = ListItem(List=shift_list, Index=0, Wrap=True)  # -> Item, Item1, Item2, Item3
list_item_2 = ListItem(List=sub_list.List, Index=0, Wrap=True)  # -> Item, Item1, Item2, Item3
_4point_surface = _4PointSurface(CornerA=list_item_2.Item, CornerB=list_item_2.Item1, CornerC=list_item.Item1, CornerD=list_item.Item)
_4point_surface_2 = _4PointSurface(CornerA=list_item_2.Item3, CornerB=list_item_2.Item, CornerC=list_item.Item, CornerD=list_item.Item3)
_4point_surface_3 = _4PointSurface(CornerA=list_item_2.Item2, CornerB=list_item_2.Item3, CornerC=list_item.Item3, CornerD=list_item.Item2)
_4point_surface_4 = _4PointSurface(CornerA=list_item_2.Item1, CornerB=list_item_2.Item2, CornerC=list_item.Item2, CornerD=list_item.Item1)
brep_join = BrepJoin(Breps=[_4point_surface, _4point_surface_4, _4point_surface_3, _4point_surface_2])  # -> Breps, Closed
breps = ClusterOutput(brep_join.Breps)

# ==== cluster Cluster_9
point = ClusterInput()
curve = ClusterInput()
point_2 = Point(point)
curve_closest_point = CurveClosestPoint(Point=point_2, Curve=curve)  # -> Point, Parameter, Distance
smaller_than = SmallerThan(FirstNumber=curve_closest_point.Distance, SecondNumber="20.0")  # -> SmallerThan, OrEqualTo
cull_pattern = CullPattern(List=point_2, CullPattern=smaller_than.SmallerThan)
list = ClusterOutput(cull_pattern)
