# Grasshopper definition connector.gh (Grasshopper 1.0.7)

y_size_bottom = Panel("20.0")
radius_cylinder = Panel("9.75")
x_size = Panel("20")
y_size = Panel("20.0")
x_dis_hole = Panel("0")
point = Point(<point referenced from the Rhino model>)
line = Line(Line((-205.6773664, 165.3654174, 373.8001196), (-184.3226336, 153.6345732, 368.1998804)))
number = Number(y_size_bottom)
number_2 = Number(y_size)
number_3 = Number(x_dis_hole)
curve = Curve(line)
number_4 = Number(x_size)
point_2 = Point(point)
number_5 = Number(radius_cylinder)

extend_curve = ExtendCurve(Curve=curve, Type=0, Start=100, End=100)
pipe = Pipe(Curve=extend_curve, Radius=number_5, Caps=1)

construct_domain = ConstructDomain(DomainStart=expr("-0.5*x", number), DomainEnd=expr("0.5*x", number))

unit_x = UnitX(Factor=number_3)
move = Move(Geometry=point_2, Motion=expr("-x", unit_x))  # -> Geometry, Transform
move_2 = Move(Geometry=point_2, Motion=unit_x)  # -> Geometry, Transform
cylinder = Cylinder(Base=[move.Geometry, move_2.Geometry], Radius="1.65", Length="-12")
cap_holes = CapHoles(Brep=cylinder)

y_size_bottom_2 = Panel("40")
radius = Panel("20.0")
radius_2 = Panel("20.0")
construct_domain_2 = ConstructDomain(DomainStart=expr("-0.5*x", y_size_bottom_2), DomainEnd=expr("0.5*x", y_size_bottom_2))
circle = Circle(Plane=point_2, Radius=radius)

unit_z = UnitZ(Factor=1)
construct_domain_3 = ConstructDomain(DomainStart=expr("-0.5*x", number_4), DomainEnd=expr("0.5*x", number_4))
construct_domain_4 = ConstructDomain(DomainStart=expr("-0.5*x", number_2), DomainEnd=expr("0.5*x", number_2))
vector = Vector(curve)
cross_product = CrossProduct(VectorA=unit_z, VectorB=vector, Unitize=True)  # -> Vector, Length
number_6 = Number("20")
construct_domain_5 = ConstructDomain(DomainStart=expr("-0.5*x", number_6), DomainEnd=expr("0.5*x", number_6))
subtraction = Subtraction(A=number_5, B="5")
rectangle = Rectangle(Plane=point_2, XSize=construct_domain_3, YSize=construct_domain_4, Radius=0)  # -> Rectangle, Length

end_points = EndPoints(Curve=curve)  # -> Start, End
construct_plane = ConstructPlane(Origin=end_points.End, XAxis=vector, YAxis=cross_product.Vector)  # disabled
construct_plane_2 = ConstructPlane(Origin=end_points.Start, XAxis=vector, YAxis=cross_product.Vector)  # disabled
panel = Panel("1.65")  # disabled
panel_2 = Panel("22")  # disabled
cylinder_2 = Cylinder(Base=[construct_plane_2, construct_plane], Radius=panel, Length=panel_2)  # disabled
cap_holes_2 = CapHoles(Brep=cylinder_2)  # disabled

midpoint = MidPoint(A=end_points.Start, B=end_points.End)
point_3 = Point(midpoint)
construct_plane_3 = ConstructPlane(Origin=point_3, XAxis=vector, YAxis=cross_product.Vector)
plane_offset = PlaneOffset(BasePlane=construct_plane_3, Offset=subtraction)
rectangle_2 = Rectangle(Plane=plane_offset, XSize=construct_domain_5, YSize=construct_domain, Radius=0)  # -> Rectangle, Length
loft = Loft(
    Curves=[rectangle.Rectangle, rectangle_2.Rectangle],
    Options={Adjust=False, Closed=False, LoftEnds=0, LoftSimp=0, LoftType=0, Rebuild=10, Refit=0.01})
cap_holes_3 = CapHoles(Brep=loft)

circle_2 = Circle(Plane=plane_offset, Radius=radius_2)
plane_offset_2 = PlaneOffset(BasePlane=plane_offset, Offset="4")
rectangle_3 = Rectangle(Plane=plane_offset, XSize=construct_domain_5, YSize=construct_domain_2, Radius=0)  # -> Rectangle, Length
rectangle_4 = Rectangle(Plane=plane_offset_2, XSize=construct_domain_5, YSize=construct_domain_2, Radius=0)  # -> Rectangle, Length
loft_2 = Loft(
    Curves=[circle_2, circle],
    Options={Adjust=False, Closed=False, LoftEnds=0, LoftSimp=0, LoftType=0, Rebuild=10, Refit=0.01})
cap_holes_4 = CapHoles(Brep=loft_2)
solid_difference = SolidDifference(BrepsA=cap_holes_3, BrepsB=flatten([cap_holes, pipe]))
solid_difference_2 = SolidDifference(BrepsA=cap_holes_4, BrepsB=flatten(pipe))
brep = Brep(solid_difference)

# ==== cluster MidPoint
A = ClusterInput()
B = ClusterInput()
addition = Addition(A=A, B=B)
point = Point(expr("0.5*x", addition))
point_2 = ClusterOutput(point)
