# Grasshopper definition distance_between_lines.gh (Grasshopper 1.0.7)

curve = Curve(<curve referenced from the Rhino model>)
curve_2 = Curve(<curve referenced from the Rhino model>)
cluster = Cluster(curve=curve, curve_2=curve_2)
cluster_2 = Cluster(curve=curve_2, curve_2=curve)
distance = Distance(PointA=cluster_2, PointB=cluster)
panel = Panel(distance)

# ==== cluster Cluster
curve = ClusterInput()
curve_2 = ClusterInput()
curve_3 = Curve(curve)
curve_4 = Curve(curve_2)
cross_product = CrossProduct(VectorA=curve_3, VectorB=curve_4, Unitize=False)  # -> Vector, Length
end_points = EndPoints(Curve=curve_3)  # -> Start, End
line_sdl = LineSDL(Start=end_points.Start, Direction=cross_product.Vector, Length=1)
plane_3pt = Plane3Pt()
line_line = LineLine(LineA=curve_3, LineB=line_sdl)
line_plane = LinePlane(Line=curve_4, Plane=line_line)  # -> Point, ParamL, ParamP
point = ClusterOutput(line_plane.Point)
