# Grasshopper definition load_cloud.gh (Grasshopper 1.0.7)

path = Panel("C:\Users\77777777\source\repos\digital_future\data_3D\")
percentage = Panel("0.2")
load_robot_base = GhPythonScript(path=path, percentage=percentage)  # -> out, m
# ---------- load_robot_base: Python ----------
#import ghpythonlib.treehelpers as th
import Rhino.Geometry as rg
import re

f = open(path+"cloud.txt")
lines = f.readlines()
m = []
count = -1
skip = int(1.0/percentage)

for line in lines:
    count += 1
    if count % skip != 0:
        continue
    line = line.replace("  ", " ")
    line = line.replace("  ", " ")
    while line[0] == ' ':
        line = line[1:]
    nums = re.split(" ", line)
#    print nums
    m.append(rg.Point3d(float(nums[0]), float(nums[1]), float(nums[2])))
f.close()
# ---------- end load_robot_base ----------
point = Point(load_robot_base.m)
panel = Panel(load_robot_base.m)
