# Grasshopper definition visualization.gh (Grasshopper 1.0.7)

# ---- group: design.txt
# Load Design
path = Panel("C:\Users\77777777\source\repos\machine_perception\demo5.1_final\gh\design.txt")
load_markers = GhPythonScript(path=path, num="37")  # -> out, r, start, dir; inputs num: Int32
# ---------- load_markers: Python ----------
import Rhino.Geometry as rg

r = []
start = []
dir = []

f = open(path)
for _ in range(num):
    data = f.readline().split(" ")
    r.append(float(data[0]))
    start.append(rg.Point3d(float(data[1]), float(data[2]), float(data[3])))
    dir.append(rg.Vector3d(float(data[4]), float(data[5]), float(data[6])))

f.close()
# ---------- end load_markers ----------
vector_length = VectorLength(Vector=load_markers.dir)
line_sdl = LineSDL(Start=load_markers.start, Direction=load_markers.dir, Length=vector_length)

# ---- group: design_segments
path_2 = Panel("C:\Users\77777777\source\repos\machine_perception\demo5.1_final\gh\design_seg.txt")
load_markers_2 = GhPythonScript(path=path_2, num="6", r=load_markers.r, start=load_markers.start, dir=load_markers.dir)  # -> out, m_r, m_axis, b_r, b_axis; inputs num: Int32, r: list, start: list of Point3d, dir: list of Vector3d
# ---------- load_markers_2: Python ----------
import Rhino.Geometry as rg


def get_line(start, dir, param, length):
    return rg.Line(start+dir/dir.Length*(param-0.5*length), 
                   start+dir/dir.Length*(param+0.5*length))

m_r = []
m_axis = []
b_r = []
b_axis = []

f = open(path)
for m_index in range(num):
    data = f.readline().split(" ")
    if int(data[0]) == -1:
        continue
    # first connection
    b_index = int(data[1])
    m_param = float(data[2])
    b_param = float(data[3])
    m_r.append(r[m_index])
    m_axis.append(get_line(start[m_index], dir[m_index], m_param, 0.04))
    b_r.append(r[b_index])
    b_axis.append(get_line(start[b_index], dir[b_index], b_param, 0.04))
    # second connection
    if int(data[0]) == 1:
        b_index = int(data[4])
        m_param = float(data[5])
        b_param = float(data[6])
        m_r.append(r[m_index])
        m_axis.append(get_line(start[m_index], dir[m_index], m_param, 0.04))
        b_r.append(r[b_index])
        b_axis.append(get_line(start[b_index], dir[b_index], b_param, 0.04))
    if int(data[0]) == 0:
        m_param = dir[m_index].Length-0.02
        m_r.append(r[m_index])
        m_axis.append(get_line(start[m_index], dir[m_index], m_param, 0.04))
#    elif float(data[0]) == 0:
#    r.append(float(data[0]))
#    start.append(rg.Point3d(float(data[1]), float(data[2]), float(data[3])))
#    dir.append(rg.Vector3d(float(data[4]), float(data[5]), float(data[6])))

f.close()
# ---------- end load_markers_2 ----------

# ---- group: design_targets
path_3 = Panel("C:\Users\77777777\source\repos\machine_perception\demo5.1_final\gh\design_targets.txt")
load_markers_3 = GhPythonScript(path=path_3, num="16")  # -> out, targets; inputs num: Int32
# ---------- load_markers_3: Python ----------
import Rhino.Geometry as rg

targets = []

f = open(path)
for _ in range(num):
    data = f.readline().split(" ")
    targets.append(rg.Point3d(float(data[0]), float(data[1]), float(data[2])))

f.close()
# ---------- end load_markers_3 ----------

# ----
# Load Markers
path_4 = Panel("C:\Users\77777777\source\repos\machine_perception\demo5.1_final\gh")  # disabled

# ----
# Fake Data
line = Line(Line((-0.6704594609, 0.2210542228, 1.579030581), (-0.7018927845, 0.2361720111, 1.598611149)))
load_markers_4 = GhPythonScript(line=line, r="9.67")  # -> out; inputs line: Line
# ---------- load_markers_4: Python ----------
import Rhino.Geometry as rg

print "%f %f %f %f %f %f %f" % \
      (r,
       line.FromX,
       line.FromY,
       line.FromZ,
       line.ToX - line.FromX, 
       line.ToY - line.FromY, 
       line.ToZ - line.FromZ)
# ---------- end load_markers_4 ----------
panel = Panel(load_markers_4)

panel_2 = Panel("7")  # disabled
line_2 = Line(load_markers_2.b_axis)
point = Point(load_markers_3.targets)
pipe = Pipe(Curve=load_markers_2.b_axis, Radius=load_markers_2.b_r, Caps=0)
pipe_2 = Pipe(Curve=load_markers_2.m_axis, Radius=load_markers_2.m_r, Caps=0)
line_3 = Line(line_sdl)
ghpython_script = GhPythonScript(n=panel_2)  # -> out; inputs n: Int32; disabled
# ---------- ghpython_script: Python ----------
for i in range(n):
    print ("MARKER_%02d") % i
# ---------- end ghpython_script ----------

# ---- group: MARKERS
load_markers_5 = GhPythonScript(path=path_4, num=panel_2)  # -> out, m; inputs num: Int32; disabled
# ---------- load_markers_5: Python ----------
import ghpythonlib.treehelpers as t

m = []
for i in range(num):
    m.append([])
    f = open(path+("w2k_%d.txt"%i))
    for _ in range(16):
        m[i].append(f.readline())
    f.close()
m = t.list_to_tree(m)
# ---------- end load_markers_5 ----------
panel_3 = Panel("4")  # disabled

# ---- group: MARKERS / m to MM
ghpython_script_2 = GhPythonScript(x=load_markers_5.m)  # -> out, a; inputs x: list; disabled
# ---------- ghpython_script_2: Python ----------
a = []
for i in range(len(x)):
    if i == 3 or i == 7 or i == 11:
        a.append(1000.0*x[i])
    else:
        a.append(x[i])
# ---------- end ghpython_script_2 ----------

# ---- group: MARKERS (continued)
construct_matrix = ConstructMatrix(Rows=panel_3, Columns=panel_3, Values=ghpython_script_2.a)  # -> flatten(Matrix); disabled
pose2plane = Pose2plane(matrix=construct_matrix)  # -> flatten(plane); disabled

# ----
plane = Plane(pose2plane)  # disabled

panel_4 = Panel("76.8")  # disabled
construct_domain = ConstructDomain(DomainStart=expr("-0.5*x", panel_4), DomainEnd=expr("0.5*x", panel_4))  # disabled
text_tag_3d = TextTag3D(Location=plane, Text=ghpython_script, Size=30, Justification=5)  # disabled
rectangle = Rectangle(Plane=plane, XSize=construct_domain, YSize=construct_domain, Radius=0)  # -> Rectangle, Length; disabled

# ==== cluster Pose2plane
matrix = ClusterInput()
deconstruct_matrix = DeconstructMatrix(Matrix=matrix)  # -> Rows, Columns, Values
panel = Panel("""3
7
11""")
panel_2 = Panel("""0
4
8""")
panel_3 = Panel("""1
5
9""")
list_item = ListItem(List=deconstruct_matrix.Values, Index=panel, Wrap=True)
list_item_2 = ListItem(List=deconstruct_matrix.Values, Index=panel_2, Wrap=True)
list_item_3 = ListItem(List=deconstruct_matrix.Values, Index=panel_3, Wrap=True)
list_item_4 = ListItem(List=list_item, Index=0, Wrap=True)  # -> Item, Item1, Item2
list_item_5 = ListItem(List=list_item_2, Index=0, Wrap=True)  # -> Item, Item1, Item2
list_item_6 = ListItem(List=list_item_3, Index=0, Wrap=True)  # -> Item, Item1, Item2
construct_point = ConstructPoint(XCoordinate=list_item_4.Item, YCoordinate=list_item_4.Item1, ZCoordinate=list_item_4.Item2)
vector_xyz = VectorXYZ(XComponent=list_item_5.Item, YComponent=list_item_5.Item1, ZComponent=list_item_5.Item2)  # -> Vector, Length
vector_xyz_2 = VectorXYZ(XComponent=list_item_6.Item, YComponent=list_item_6.Item1, ZComponent=list_item_6.Item2)  # -> Vector, Length
construct_plane = ConstructPlane(Origin=construct_point, XAxis=vector_xyz.Vector, YAxis=vector_xyz_2.Vector)
plane = ClusterOutput(construct_plane)
