# Grasshopper definition design_bf.gh (Grasshopper 1.0.7)
# plug-ins: Virtual Robot

construct_point = ConstructPoint(XCoordinate=0, YCoordinate=0, ZCoordinate="180")
xy_plane = XYPlane(Origin=construct_point)
xy_plane_2 = XYPlane(Origin=Point(0, 0, 0))
brep = Brep(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)
define_end_effector = DefineEndEffector(Geometry=brep, TCPFrame=xy_plane, MountingFrame=xy_plane_2)
point = Point(<point referenced from the Rhino model>)
predefined_kuka_kr_125_2 = PredefinedKUKAKR1252(RobRootFrame=PlaneXY(0, 0, 0), EndEffectorOptional=define_end_effector)
plane = Plane(point)
yz_plane = YZPlane(Origin=point)
flip_plane = FlipPlane(Plane=plane, ReverseX=False, ReverseY=False, SwapAxes=True)
rotate_plane = RotatePlane(Plane=yz_plane, Angle=expr("x*Pi", Slider(0.33, range=0..1)))
robot_inverse_kinematics = RobotInverseKinematics(Robot=predefined_kuka_kr_125_2, TargetTCPFrame=rotate_plane, AxisToggles=[False, False, False], useColorPreview=True)  # -> PoseGeometry, AxisValues
panel = Panel(robot_inverse_kinematics.AxisValues)
