# Grasshopper definition KukaVarProxy.gh (Grasshopper 1.0.7)
# plug-ins: Simulacrum, Virtual Robot

timer = Timer(TimerInterval=1000, Target=ghpython_script)
ghpython_script = GhPythonScript(reset=Toggle(False))  # -> out, pc; inputs reset: Boolean
# ---------- ghpython_script: Python ----------
import Rhino.Geometry as rg
import Grasshopper as gh

if reset:
    line_count = 0
    f = open('poses.txt','r')
    try:
        lines = f.readlines()
    finally:
        f.close()

if line_count < len(lines):
    nums = lines[line_count].split(" ")
    for num in nums:
        print float(num.replace("\n", ""))
line_count += 1

#    for line in lines:
#        print line
#        if count % 180 == 0:
#            pth = gh.Kernel.Data.GH_Path(count/180)
#        
#        if line[0] != "v" or line[1] == "n":
#            continue
#        nums = line.split(" ")
#        x = float(nums[1].replace(",", "."))
#        y = float(nums[2].replace(",", "."))
#        z = float(nums[3].replace(",", "."))
#        
#        pc.Add(1000 * rg.Point3d(x, y, z), pth)
#        count += 1
# ---------- end ghpython_script ----------
panel = Panel(ghpython_script.out)
number = Number([-9.029449, -87.60641, 100.5325, -4672.935, -1.762648, 4687.577])
panel_2 = Panel("""20
-87.60641
100.5325
-4672.935
-1.762648
4687.577""")
panel_3 = Panel(number)
client = TCPClient(ServerIP="141.58.154.149", ServerPort="7000", ConnectionTrigger=Toggle(False))
panel_4 = Panel("""20.0
-90
100
0.0
0.0
0.0""")

# ---- group: Write Values
write_position = WritePosition(Socket=client, Write="MyPosSimon", AxisValues=panel_4, Run=Button(), RefreshRate=20)
custom_write = KRCWrite(Socket=client, Write="SimonBool", Input="False", Run=Button(), RefreshRate=20)
panel_5 = Panel(custom_write)
panel_6 = Panel(write_position)

# ---- group: Read Values
read_position = ReadActPos(Socket=client, Run=Toggle(True), RefreshRate="300")  # -> AxisValues, TCPPlane, XYZ, ABC, E6POS, E6AXIS
custom_read = KRCRead(Socket=client, VarRead="SimonBool", ReadTrigger=Toggle(True), RefreshRate=20)
read_base = ReadBase(Socket=client, Run=Button())  # -> BASE, BASEPlane, TOOL, TOOLPlane
panel_7 = Panel(read_base.BASE)
pln = Plane(read_position.TCPPlane)
pln_2 = Plane(read_base.BASEPlane)
panel_8 = Panel(read_position.AxisValues)
panel_9 = Panel(custom_read)
pln_3 = Plane(read_base.TOOLPlane)
panel_10 = Panel(read_base.TOOL)

# ----
monitor = NetstatMonitor(Socket=client)

# ---- group: Check Connection
panel_11 = Panel(monitor)

# ----
unit_x = UnitX(Factor=1)
unit_y = UnitY(Factor=1)
pln_4 = Plane(Plane(origin=(1629.697, -136.7086, 1739.825), x=(0.5456147108, -0.5171044985, -0.659475189), y=(0.7828826434, 0.5952739638, 0.1809521337)))
kuka_kr_125_2 = PredefinedKUKAKR1252(RobRootFrame=PlaneXY(0, 0, 0))
plane2matrix = Plane2matrix(target=pln)
move = Move(Geometry=pln_4, Motion=expr("x*500", unit_y))  # -> Geometry, Transform

# ---- group: Kuka Datatype Converter
converter = Converter(E6POS=read_position.E6POS, E6AXIS=read_position.E6AXIS)  # -> E6POSNames, E6POSValues, E6AXISNames, E6AXISValues, FRAMENames, FRAMEValues
panel_12 = Panel(converter.E6POSNames)
panel_13 = Panel(converter.E6POSValues)

# ----
display_matrix = DisplayMatrix(plane2matrix)

# ---- group: Robot Sim
robot_fk = RobotForwardKinematics(Robot=kuka_kr_125_2, AxisValues=panel_8, useColorPreview=True)  # -> PoseGeometry, TCPFrame
pln_5 = Plane(robot_fk.TCPFrame)

# ----
deconstruct_matrix = DeconstructMatrix(Matrix=plane2matrix)  # -> Rows, Columns, Values
robot_inverse_kinematics = RobotInverseKinematics(Robot=kuka_kr_125_2, TargetTCPFrame=move.Geometry, AxisToggles=[False, False, False], useColorPreview=True)  # -> PoseGeometry, AxisValues
plane2matrix_2 = Plane2matrix(target=move.Geometry)
panel_14 = Panel(move.Geometry)

# ---- group: matrix to numbers
deconstruct_matrix_2 = DeconstructMatrix(Matrix=deconstruct_matrix.Values)  # -> Rows, Columns, Values
text = Text(flatten(deconstruct_matrix_2.Values))
text_join = TextJoin(Text=text, Join=" ")
panel_15 = Panel(text_join)

deconstruct_matrix_3 = DeconstructMatrix(Matrix=plane2matrix_2)  # -> Rows, Columns, Values
text_2 = Text(flatten(deconstruct_matrix_3.Values))
text_join_2 = TextJoin(Text=text_2, Join=", ")
panel_16 = Panel(text_join_2)

# ----
# save
button = Button()

# ----
# ! reset
boolean_toggle = BooleanToggle(True)

# ----
# ! delete
button_2 = Button()

c_script = CSharpScript(data=panel_15, save=button, reset=boolean_toggle, delete=button_2)  # -> out, A; inputs data: String, save: Boolean, reset: Boolean, delete: Boolean
# ---------- c_script: C# ----------
    if (reset)
      e2c = new List<string>();
    if (save)
      e2c.Add(data);
    if (delete)
      e2c.RemoveAt(e2c.Count - 1);

    A = e2c;
# ---------- c_script: C# additional code ----------
  List<string> e2c = new List<string>();
# ---------- end c_script ----------
panel_17 = Panel(c_script.A)
c_script_2 = CSharpScript(data=panel_15, save=button, reset=Toggle(True))  # -> out, A; inputs data: String, save: Boolean, reset: Boolean, delete: Boolean; same code as c_script

# ==== cluster Plane2matrix
xy_plane = XYPlane(Origin=Point(0, 0, 0))
target = ClusterInput()
orient = Orient(Source=xy_plane, Target=target)  # -> Geometry, Transform
matrix = Matrix(orient.Transform)
matrix_2 = ClusterOutput(matrix)
