# Grasshopper definition milling_tool_path_robolab_20200203.gh (Grasshopper 1.0.7)
# plug-ins: Sandbox, Virtual Robot

# ---- group: Read Existing Bamboo Diameter From Vision Part
read_file = ReadFile(File="C:\Users\zhong\Desktop\cylinder_params.txt", PerLineParse=True)
multiplication = Multiplication(A=read_file, B=2000)
panel = Panel(multiplication)

# ---- group: bamboo B (Existing) diameter
diameterc_b = Panel("""39.585
41.502""")

# ---- group: bamboo A (to be cut) diameter
diameter_a = Panel("30")

# ----
# bamboo B  in original structure(existing)
down_line = Line(Line((581.596744, -8777.938143, 230.031759), (-368.9629212, -7055.078476, 582.2963842)))
up_line = Line(Line((-484.811, -8321.265, 655.759), (192.091, -7466.088, 327.97)))
merge = Merge(Data1=up_line, Data2=down_line)

# ----
# bamboo A in original structure(to be cut)
line = Line(Line((-333.15794, -7880.498525, 524.9930889), (268.2186326, -7854.873819, 328.629192)))

# ---- group: Spindle Property
diameter_tool = Panel("21")
cutter_go_outwards_dis = Panel("30")
cutter_length_tool = Panel("10")

# ---- group: Spindle Setting
tool_no = Panel("1")
spindle_speed_rpm = Panel("14000")
feed_mm_min = Panel("2400")

# ---- group: Read Data From Kuka Monitor
z = Panel("1070.68")
y = Panel("-2265.53")
x = Panel("407.91")
x_2 = Panel("-118.03")
y_2 = Panel("-2262.94")
z_2 = Panel("1070.68")

# ----
construct_point = ConstructPoint(XCoordinate=x_2, YCoordinate=y_2, ZCoordinate=z)
construct_point_2 = ConstructPoint(XCoordinate=x, YCoordinate=y, ZCoordinate=z)
line_2 = Line(StartPoint=construct_point, EndPoint=construct_point_2)
line_3 = Line(line_2)
cluster = Cluster_3(geometry=graft(merge), line_2=line, factor=Slider(0, range=-1..1), line=line_3)
# bamboo A on turntable (to be cut)
curve = Curve(line_2)
# bamboo B for cutting path (existing)
curve_2 = Curve(cluster)
pipe = Pipe(Curve=curve, Radius=expr("0.5 * x", diameter_a), Caps=1)
cluster_2 = Cluster(curve=curve, curve_2=curve_2)
cluster_3 = Cluster(curve=curve_2, curve_2=curve)
point = Point(cluster_3)
point_2 = Point(cluster_2)
line_4 = Line(StartPoint=point_2, EndPoint=point)
cluster_4 = Cluster_2(point=point_2, vector_a=curve, curve=curve_2, A=diameter_a, B=graft(diameterc_b))  # -> geometry, geometry_2
cross_product = CrossProduct(VectorA=line_4, VectorB=curve_2, Unitize=False)  # -> Vector, Length

# ---- group: arcs
# might be flipped, need to be checked
point_3 = Point(cluster_4.geometry_2)
point_4 = Point(cluster_4.geometry)
line_5 = Line(StartPoint=point_4, EndPoint=point_3)
length = Length(Curve=line_5)
division = Division(A=length, B=cutter_length_tool)
integer = Integer(division)
divide_curve = DivideCurve(Curve=line_5, Count=integer, Kinks=False)  # -> Points, Tangents, Parameters
subtraction = Subtraction(A=graft(diameterc_b), B=diameter_tool)
construct_plane = ConstructPlane(Origin=divide_curve.Points, XAxis=line_4, YAxis=cross_product.Vector)
arc = Arc(Plane=simplify(construct_plane), Radius=expr("x * 0.5", simplify(subtraction)), Angle=Domain(-1.570796327, 1.570796327))  # -> Arc, Length
custom_preview = CustomPreview(Geometry=arc.Arc)

# ---- group: tool path
curve_3 = Curve(arc.Arc)
end_points = EndPoints(Curve=curve_3)  # -> Start, End
line_sdl = LineSDL(Start=end_points.Start, Direction=expr("-x", line_4), Length=cutter_go_outwards_dis)
line_sdl_2 = LineSDL(Start=end_points.End, Direction=expr("-x", line_4), Length=cutter_go_outwards_dis)
end_points_2 = EndPoints(Curve=line_sdl)  # -> Start, End
end_points_3 = EndPoints(Curve=line_sdl_2)  # -> Start, End
shift_list = ShiftList(List=end_points_2.End, Shift=-1, Wrap=False)
shift_list_2 = ShiftList(List=end_points_2.End, Shift=1, Wrap=False)
shift_list_3 = ShiftList(List=end_points_3.End, Shift=-1, Wrap=False)
shift_list_4 = ShiftList(List=end_points_3.End, Shift=1, Wrap=False)
rebuild_curve = RebuildCurve(Curve=arc.Arc, Degree=1, Count=20, Tangents=False)

# ----
line_6 = Line(StartPoint=shift_list_4, EndPoint=shift_list)
join_curves = JoinCurves(Curves=flatten([line_sdl, line_sdl_2, rebuild_curve, line_6]), Preserve=False)

# ---- group: robot sim
curve_4 = Curve(join_curves)
explode = Explode(Curve=curve_4, Recursive=True)  # -> Segments, Vertices
construct_plane_2 = ConstructPlane(Origin=explode.Vertices, XAxis=line_4, YAxis=cross_product.Vector)
rotate_plane = RotatePlane(Plane=construct_plane_2, Angle="0.0 * Pi")  # -> simplify(Plane)
flip_plane = FlipPlane(Plane=flatten(rotate_plane), ReverseX=False, ReverseY=False, SwapAxes=True)
reverse_list = ReverseList(List=rotate_plane)
flip_plane_2 = FlipPlane(Plane=flip_plane, ReverseX=False, ReverseY=False, SwapAxes=True)
interpolate_frames = InterpolateFrames(Frames=flip_plane_2, Length=Slider(0.998, range=0..1), Step="1", Reset=Toggle(True))  # -> Frame, Percent, CurrentIndex
predefined_spindle_end_effector = PredefinedSpindleEndEffector()
predefined_kuka_kr_125_2 = PredefinedKUKAKR1252(RobRootFrame=PlaneXY(0, 0, 0), EndEffectorOptional=predefined_spindle_end_effector)
robot_inverse_kinematics = RobotInverseKinematics(
    Robot=predefined_kuka_kr_125_2,
    TargetTCPFrame=interpolate_frames.Frame,
    AxisToggles=[False, False, False],
    useColorPreview=True)  # -> PoseGeometry, AxisValues

# ---- group: gcode
deconstruct_plane = DeconstructPlane(Plane=flip_plane_2)  # -> Origin, XAxis, YAxis, ZAxis
list_length = ListLength(List=deconstruct_plane.Origin)
repeat_data = RepeatData(Data="G1", Length=expr("x - 2", list_length))
nc_settings = NCSettings(Tool=tool_no, Speed=spindle_speed_rpm, Feed=feed_mm_min)
merge_2 = Merge(Data1="G0", Data2=flatten(repeat_data), Data3="G0")
nc_generation = NCGeneration(Points=deconstruct_plane.Origin, Vectors=deconstruct_plane.ZAxis, Feed=merge_2, Settings=nc_settings)

# ----
split = SplitList(List=nc_generation, Index="6")  # -> ListA, ListB
merge_3 = Merge(Data1=flatten(split.ListA), Data2="TCPZROT / -90.0", Data3=flatten(split.ListB))
panel_2 = Panel(merge_3)

# ==== cluster Cluster
curve = ClusterInput()
curve_2 = ClusterInput()
curve_3 = Curve(curve)
curve_4 = Curve(curve_2)
cross_product = CrossProduct(VectorA=curve_3, VectorB=curve_4, Unitize=False)  # -> Vector, Length
end_points = EndPoints(Curve=curve_3)  # -> Start, End
line_sdl = LineSDL(Start=end_points.Start, Direction=cross_product.Vector, Length=1)
plane_3pt = Plane3Pt()
line_line = LineLine(LineA=curve_3, LineB=line_sdl)
line_plane = LinePlane(Line=curve_4, Plane=line_line)  # -> Point, ParamL, ParamP
point = ClusterOutput(line_plane.Point)

# ==== cluster Cluster_2
curve = ClusterInput()
curve_2 = Curve(curve)
vector_a = ClusterInput()
A = ClusterInput()
B = ClusterInput()
angle = Angle(VectorA=vector_a, VectorB=curve_2)  # -> Angle, Reflex
maximum = Maximum(A=A, B=B)
sine = Sine(Value=angle.Angle)
multiplication = Multiplication(A=maximum, B="1.2/2")
division = Division(A=multiplication, B=sine)
vector = Vector(curve_2)
point = ClusterInput()
multiplication_2 = Multiplication(A=vector, B=division)
point_2 = Point(point)
move = Move(Geometry=point_2, Motion=expr("-x", multiplication_2))  # -> Geometry, Transform
move_2 = Move(Geometry=point_2, Motion=multiplication_2)  # -> Geometry, Transform
geometry = ClusterOutput(move_2.Geometry)
geometry_2 = ClusterOutput(move.Geometry)

# ==== cluster Cluster_3
line = ClusterInput()
line_2 = ClusterInput()
line_3 = Line(line)
line_4 = Line(line_2)
end_points = EndPoints(Curve=line_3)  # -> Start, End
end_points_2 = EndPoints(Curve=line_4)  # -> Start, End
vector = Vector(line_4)
point = Point(end_points.Start)
vector_2 = Vector(line_3)
point_2 = Point(end_points_2.Start)
vector_display_ex = VectorDisplayEx(Point=point_2, Vector=vector, Colour=RGB(0, 0, 0), Width=2)
vector_display_ex_2 = VectorDisplayEx(Point=point, Vector=vector_2, Colour=RGB(0, 0, 0), Width=2)
geometry = ClusterInput()
plane_normal = PlaneNormal(Origin=point, ZAxis=vector_2)
plane_normal_2 = PlaneNormal(Origin=point_2, ZAxis=vector)
factor = ClusterInput()
orient = Orient(Geometry=geometry, Source=plane_normal_2, Target=plane_normal)  # -> Geometry, Transform
pi = Pi(Factor=factor)
rotate_axis = RotateAxis(Geometry=orient.Geometry, Angle=pi, Axis=line_3)  # -> Geometry, Transform
panel = Panel(orient.Geometry)
geometry_2 = ClusterOutput(rotate_axis.Geometry)
