# Grasshopper definition fab_ts.gh (Grasshopper 1.0.7)
# plug-ins: Sandbox, Virtual Robot

# ---- group: Read Data From Kuka Monitor
x = Panel("965.070568")
y = Panel("451")
# scan global geometry
x_2 = Panel("2465.070568")
y_2 = Panel("-1049.0")
x_3 = Panel("2465.070568")
y_3 = Panel("451")
z = Panel("52.0")

# ----
height_of_table = Panel("1000")

# ---- group: scan distance (camera to bamboo A)
scan_distance_350mm_500mm = Panel("350")

# ---- group: bamboo A (to be cut) diameter
diameter_a = Panel("30")

# ---- group: Current State of Fabrication
# digital design & fabrication order
number_slider = Slider(6, range=0..8)

# ---- group: Read Data From Kuka Monitor
# scan bamboo A on turntable
x_4 = Panel("143.645")
y_4 = Panel("-1851.148")
y_5 = Panel("-2527.205")
x_5 = Panel("146.235")
z_2 = Panel("1070.68")

# ---- group: No.7
panel = Panel("""1
4""")
geometry = Geometry(<curve referenced from the Rhino model>)

# ---- group: No.8
panel_2 = Panel("""2
5""")
geometry_2 = Geometry(<curve referenced from the Rhino model>)

# ---- group: hand-eye calibration
# end to camera
# T(6->Camera)
matrix = Matrix({0;0=0.9559237072, 0;1=-0.2432103468, 0;2=0.1644949642, 0;3=0, 1;0=0.1644949642, 1;1=0.9076733712, 1;2=0.3860964361, 1;3=2.819077862, 2;0=-0.2432103468, 2;1=-0.3420201433, 2;2=0.9076733712, 2;3=24.97393957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})

# ---- group: No.1
panel_3 = Panel("Null")
geometry_3 = Geometry(<curve referenced from the Rhino model>)

# ---- group: No.2
panel_4 = Panel("Null")
geometry_4 = Geometry(<curve referenced from the Rhino model>)

# ---- group: No.3
panel_5 = Panel("""0
1""")
geometry_5 = Geometry(<curve referenced from the Rhino model>)

# ---- group: No.5
panel_6 = Panel("""2
0""")
geometry_6 = Geometry(<curve referenced from the Rhino model>)

# ---- group: No.6
panel_7 = Panel("""0
3""")
geometry_7 = Geometry(<curve referenced from the Rhino model>)

# ---- group: No.4
panel_8 = Panel("""1
2""")
geometry_8 = Geometry(<curve referenced from the Rhino model>)

# ---- group: No.0
panel_9 = Panel("Null")
geometry_9 = Geometry(<curve referenced from the Rhino model>)

# ---- group: center of base plate in digital
point = Point(Point(1715.070568, -299, 52))

# ---- group: Spindle Setting
tool_no = Panel("1")
spindle_speed_rpm = Panel("14000")
feed_mm_min = Panel("2400")

# ---- group: bamboo A (to be cut) diameter
diameter_a_2 = Panel("30")

# ---- group: bamboo B (Existing) diameter
diameterc_b = Panel("""39.585
41.502""")

# ---- group: Spindle Property
diameter_tool = Panel("21")
cutter_go_outwards_dis = Panel("30")
cutter_length_tool = Panel("10")

# ---- group: base plate
construct_point = ConstructPoint(XCoordinate=x_2, YCoordinate=y_2, ZCoordinate=z)
construct_point_2 = ConstructPoint(XCoordinate=x_3, YCoordinate=y_3, ZCoordinate=z)
construct_point_3 = ConstructPoint(XCoordinate=x, YCoordinate=y, ZCoordinate=z)
point_2 = Point(construct_point)
point_3 = Point(construct_point_2)
point_4 = Point(construct_point_3)
rectangle_3pt = Rectangle3Pt(PointA=point_2, PointB=point_3, PointC=point_4)  # -> Rectangle, Length

# ----
construct_point_4 = ConstructPoint(XCoordinate=x_5, YCoordinate=y_4, ZCoordinate=z_2)
construct_point_5 = ConstructPoint(XCoordinate=x_4, YCoordinate=y_5, ZCoordinate=z_2)

# ---- group: target plane for orient
unit_z = UnitZ(Factor=1)
vector_2pt = Vector2Pt(PointA=construct_point_4, PointB=construct_point_5, Unitize=False)  # -> Vector, Length
point_5 = Point(construct_point_4)
construct_plane = ConstructPlane(Origin=point_5, XAxis=vector_2pt.Vector, YAxis=unit_z)

# ----
line = Line(StartPoint=construct_point_5, EndPoint=construct_point_4)
merge = Merge(
    Data1=geometry_9,
    Data2=geometry_3,
    Data3=geometry_4,
    Data4=geometry_5,
    Data5=geometry_8,
    Data6=geometry_6,
    Data7=geometry_7,
    Data8=geometry,
    Data9=geometry_2)
rectangle = Rectangle(rectangle_3pt.Rectangle)

# ----
# bamboo A
curve = Curve(line)

# ---- group: desired scan point on bamboo
evaluate_curve = EvaluateCurve(Curve=reparameterize(curve), Parameter="0.8")  # -> Point, Tangent, Angle
unit_z_2 = UnitZ(Factor=scan_distance_350mm_500mm)
move = Move(Geometry=evaluate_curve.Point, Motion=unit_z_2)  # -> Geometry, Transform

# ----
entwine = Entwine(
    Branch00=panel_9,
    Branch01=panel_3,
    Branch02=panel_4,
    Branch03=panel_5,
    Branch04=panel_8,
    Branch05=panel_6,
    Branch06=panel_7,
    Branch07=panel,
    Branch08=panel_2,
    FlattenInputs=True)  # -> simplify(Result)

# ---- group: center of base plate in real
area = Area(Geometry=rectangle)  # -> Area, Centroid

# ---- group: vector along base plate
vector_2pt_2 = Vector2Pt(PointA=point_4, PointB=point_3, Unitize=False)  # -> Vector, Length
vector_2pt_3 = Vector2Pt(PointA=point_2, PointB=point_3, Unitize=False)  # -> Vector, Length

# ----
pipe = Pipe(Curve=curve, Radius=expr("0.5 * x", diameter_a), Caps=1)
vector = Vector(vector_2pt_2.Vector)
point_6 = Point(area.Centroid)
vector_2pt_4 = Vector2Pt(PointA=point, PointB=point_6, Unitize=False)  # -> Vector, Length

# ---- group: align digital model in real world
geometry_10 = Geometry(merge)
move_2 = Move(Geometry=geometry_10, Motion=vector_2pt_4.Vector)  # -> Geometry, Transform

# ----
vector_2 = Vector(vector_2pt_3.Vector)
geometry_11 = Geometry(move_2.Geometry)
tree_branch = TreeBranch(Tree=entwine, Path=number_slider, MaintainPaths=True)
point_7 = Point(move.Geometry)

# ---- group: scan curve
pi = Pi(Factor=expr("-x", "0.3"))
pi_2 = Pi(Factor="0.3")
point_8 = Point(point_7)
rotate_axis = RotateAxis(Geometry=point_8, Angle=pi, Axis=curve)  # -> Geometry, Transform
rotate_axis_2 = RotateAxis(Geometry=point_8, Angle=pi_2, Axis=curve)  # -> Geometry, Transform
arc_3pt = Arc3Pt(PointA=rotate_axis.Geometry, PointB=point_8, PointC=rotate_axis_2.Geometry)  # -> Arc, Plane, Radius

# ---- group: generate scanning path
unit_z_3 = UnitZ(Factor=height_of_table)
move_3 = Move(Geometry=point_6, Motion=expr("0.5 * x", unit_z_3))  # -> Geometry, Transform
point_9 = Point(move_3.Geometry)
move_4 = Move(Geometry=point_9, Motion=expr("- 0.3 * x", vector))  # -> Geometry, Transform
unit_z_4 = UnitZ(Factor="300")
move_5 = Move(Geometry=point_9, Motion=expr("-0.6*x", vector_2))  # -> Geometry, Transform
move_6 = Move(Geometry=point_9, Motion=expr("0.6*x", vector_2))  # -> Geometry, Transform
move_7 = Move(Geometry=move_4.Geometry, Motion=unit_z_4)  # -> Geometry, Transform
point_10 = Point(move_6.Geometry)
point_11 = Point(move_7.Geometry)
point_12 = Point(move_5.Geometry)
arc_3pt_2 = Arc3Pt(PointA=point_10, PointB=point_11, PointC=point_12)  # -> Arc, Plane, Radius

# ----
list_item = ListItem(List=geometry_11, Index=tree_branch, Wrap=False)
geometry_12 = Geometry(arc_3pt.Arc)

# ---- group: plane for moving path
curve_2 = Curve(geometry_12)
divide_curve = DivideCurve(Curve=reparameterize(curve_2), Count="100", Kinks=False)  # -> Points, Tangents, Parameters
evaluate_curve_2 = EvaluateCurve(Curve=reparameterize(curve_2), Parameter=divide_curve.Parameters)  # -> Point, Tangent, Angle
line_2 = Line(curve)
point_13 = Point(evaluate_curve_2.Point)
end_points = EndPoints(Curve=line_2)  # -> Start, End
vector_2pt_5 = Vector2Pt(PointA=end_points.Start, PointB=end_points.End, Unitize=True)  # -> expr("-x", Vector), Length
cross_product = CrossProduct(VectorA=evaluate_curve_2.Tangent, VectorB=vector_2pt_5.Vector, Unitize=True)  # -> Vector, Length
vector_display_ex = VectorDisplayEx(Point=point_13, Vector=expr("x * 100", cross_product.Vector), Colour=ColourSwatch(SwatchColor=RGB(8, 135, 255)), Width=2)
vector_display_ex_2 = VectorDisplayEx(
    Point=point_13,
    Vector=expr("x*100", evaluate_curve_2.Tangent),
    Colour=ColourSwatch(SwatchColor=RGB(255, 120, 120)),
    Width=2)
vector_display_ex_3 = VectorDisplayEx(Point=point_13, Vector=expr("x * 100", vector_2pt_5.Vector), Colour=ColourSwatch(SwatchColor=RGB(99, 212, 120)), Width=2)
vector_3 = Vector(cross_product.Vector)
vector_4 = Vector(evaluate_curve_2.Tangent)
vector_5 = Vector(vector_2pt_5.Vector)
point_14 = Point(divide_curve.Points)
construct_plane_2 = ConstructPlane(Origin=point_14, XAxis=vector_4, YAxis=vector_5)  # -> simplify(graft(Plane))
rotate_plane = RotatePlane(Plane=construct_plane_2, Angle="-0.5 * Pi")  # -> simplify(Plane)

# ----
list_item_2 = ListItem(List=geometry_11, Index=number_slider, Wrap=False)

# ---- group: geometry to orient
# milling path generation
entwine_2 = Entwine(Branch00=list_item_2, Branch01=list_item, FlattenInputs=True)
geometry_13 = Geometry(entwine_2)

# ----
panel_10 = Panel(list_item_2)
plane = Plane(rotate_plane)

# ---- group: No. Mark Text
end_points_2 = EndPoints(Curve=geometry_11)  # -> Start, End
panel_11 = Panel("""0
1
2
3
4
5
6
7
8""")
point_15 = Point(end_points_2.End)
text_tag_3d = TextTag3D(Location=point_15, Text=panel_11, Size="50", Colour=ColourSwatch(SwatchColor=RGB(0, 255, 213)), Justification=7)

# ---- group: bamboo to connect
pipe_2 = Pipe(Curve=list_item, Radius=" 15", Caps=1)
custom_preview = CustomPreview(Geometry=pipe_2, Material=ColourSwatch(SwatchColor=RGB(255, 255, 255)))

# ---- group: bamboo to mill
pipe_3 = Pipe(Curve=list_item_2, Radius=" 15", Caps=1)
custom_preview_2 = CustomPreview(Geometry=pipe_3, Material=ColourSwatch(SwatchColor=RGB(255, 166, 0)))

# ---- group: robot simulation
invert_matrix = InvertMatrix(Matrix=matrix, Tolerance=0)  # -> Matrix, Success; disabled
plane2matrix = Plane2matrix(target=plane)  # disabled
multiplication = Multiplication(A=plane2matrix, B=invert_matrix.Matrix)  # disabled
pose2plane = Pose2plane(matrix=multiplication)  # -> flatten(plane); disabled
number_slider_2 = Slider(0, range=0..1)  # disabled
boolean_toggle = BooleanToggle(True)  # disabled
panel_12 = Panel("1")  # disabled
predefined_kuka_kr_125_2 = PredefinedKUKAKR1252(RobRootFrame=PlaneXY(0, 0, 0))  # disabled
interpolate_frames = InterpolateFrames(Frames=flatten(pose2plane), Length=number_slider_2, Step=panel_12, Reset=boolean_toggle)  # -> Frame, Percent, CurrentIndex; disabled
robot_inverse_kinematics = RobotInverseKinematics(
    Robot=predefined_kuka_kr_125_2,
    TargetTCPFrame=interpolate_frames.Frame,
    AxisToggles=[False, False, False],
    useColorPreview=True)  # -> PoseGeometry, AxisValues; disabled

# ----
geometry_14 = Geometry(arc_3pt_2.Arc)
panel_13 = Panel(robot_inverse_kinematics.AxisValues)  # disabled

# ---- group: source plane for orient
tree_branch_2 = TreeBranch(Tree=simplify(geometry_13), Path="0", MaintainPaths=True)
tree_branch_3 = TreeBranch(Tree=simplify(geometry_13), Path=" 1", MaintainPaths=True)
cluster = Cluster(curve=tree_branch_3, curve_2=tree_branch_2)
cluster_2 = Cluster(curve=tree_branch_2, curve_2=tree_branch_3)
point_16 = Point(cluster)
point_17 = Point(cluster_2)
vector_2pt_6 = Vector2Pt(PointA=point_16, PointB=point_17, Unitize=True)  # -> Vector, Length
list_item_3 = ListItem(List=vector_2pt_6.Vector, Index=" 0", Wrap=True)
list_item_4 = ListItem(List=vector_2pt_6.Vector, Index="1", Wrap=True)
addition = Addition(A=list_item_3, B=list_item_4)
division = Division(A=addition, B=2)
vector_6 = Vector(division)

# ---- group: source plane for orient / bamboo A (to mill) in digital
line_3 = Line(tree_branch_2)

# ---- group: source plane for orient (continued)
end_points_3 = EndPoints(Curve=line_3)  # -> Start, End
vector_2pt_7 = Vector2Pt(PointA=end_points_3.Start, PointB=end_points_3.End, Unitize=True)  # -> Vector, Length
point_18 = Point(end_points_3.Start)
vector_7 = Vector(vector_2pt_7.Vector)
vector_display_ex_4 = VectorDisplayEx(Point=point_18, Vector=expr("x * 100", vector_7), Colour=RGB(0, 0, 0), Width=2)
vector_display_ex_5 = VectorDisplayEx(Point=point_18, Vector=expr("x * 100", vector_6), Colour=RGB(0, 0, 0), Width=2)
construct_plane_3 = ConstructPlane(Origin=point_18, XAxis=vector_7, YAxis=vector_6)

# ----
plane_2 = Plane(construct_plane)
plane_3 = Plane(construct_plane_3)
orient = Orient(Geometry=geometry_13, Source=plane_3, Target=plane_2)  # -> Geometry, Transform

# ---- group: geometry orient to turntable for milling path
geometry_15 = Geometry(simplify(orient.Geometry))

# ---- group: seperate bamboo A and bamboo B
tree_branch_4 = TreeBranch(Tree=geometry_15, Path="1", MaintainPaths=True)
tree_branch_5 = TreeBranch(Tree=geometry_15, Path="0", MaintainPaths=True)
list_item_5 = ListItem(List=tree_branch_4, Index="0", Wrap=True)
list_item_6 = ListItem(List=tree_branch_4, Index="1", Wrap=True)
line_4 = Line(list_item_6)
line_5 = Line(list_item_5)
entwine_3 = Entwine(Branch00=line_5, Branch01=line_4, FlattenInputs=True)

# ----
# bamboo A on turntable (to be cut)
curve_3 = Curve(tree_branch_5)

# ----
# bamboo B for cutting path (existing)
curve_4 = Curve(entwine_3)

pipe_4 = Pipe(Curve=curve_3, Radius=expr("0.5 * x", diameter_a_2), Caps=1)
cluster_3 = Cluster(curve=curve_3, curve_2=curve_4)
cluster_4 = Cluster(curve=curve_4, curve_2=curve_3)
point_19 = Point(cluster_4)
point_20 = Point(cluster_3)
line_6 = Line(StartPoint=point_20, EndPoint=point_19)
cluster_5 = Cluster_2(point=point_20, vector_a=curve_3, curve=curve_4, A=diameter_a_2, B=graft(diameterc_b))  # -> geometry, geometry_2
cross_product_2 = CrossProduct(VectorA=line_6, VectorB=curve_4, Unitize=False)  # -> Vector, Length

# ---- group: arcs
# might be flipped, need to be checked
point_21 = Point(cluster_5.geometry_2)
point_22 = Point(cluster_5.geometry)
line_7 = Line(StartPoint=point_22, EndPoint=point_21)
length = Length(Curve=line_7)
division_2 = Division(A=length, B=cutter_length_tool)
integer = Integer(division_2)
divide_curve_2 = DivideCurve(Curve=line_7, Count=integer, Kinks=False)  # -> Points, Tangents, Parameters
subtraction = Subtraction(A=graft(diameterc_b), B=diameter_tool)
construct_plane_4 = ConstructPlane(Origin=divide_curve_2.Points, XAxis=line_6, YAxis=cross_product_2.Vector)
arc = Arc(
    Plane=simplify(construct_plane_4),
    Radius=expr("x * 0.5", simplify(subtraction)),
    Angle=Domain(-1.570796327, 1.570796327))  # -> Arc, Length
custom_preview_3 = CustomPreview(Geometry=arc.Arc)

# ---- group: tool path
curve_5 = Curve(arc.Arc)
end_points_4 = EndPoints(Curve=curve_5)  # -> Start, End
line_sdl = LineSDL(Start=end_points_4.Start, Direction=expr("-x", line_6), Length=cutter_go_outwards_dis)
line_sdl_2 = LineSDL(Start=end_points_4.End, Direction=expr("-x", line_6), Length=cutter_go_outwards_dis)
end_points_5 = EndPoints(Curve=line_sdl)  # -> Start, End
end_points_6 = EndPoints(Curve=line_sdl_2)  # -> Start, End
shift_list = ShiftList(List=end_points_5.End, Shift=-1, Wrap=False)
shift_list_2 = ShiftList(List=end_points_5.End, Shift=1, Wrap=False)
shift_list_3 = ShiftList(List=end_points_6.End, Shift=-1, Wrap=False)
shift_list_4 = ShiftList(List=end_points_6.End, Shift=1, Wrap=False)
rebuild_curve = RebuildCurve(Curve=arc.Arc, Degree=1, Count=20, Tangents=False)

# ----
line_8 = Line(StartPoint=shift_list_4, EndPoint=shift_list)
join_curves = JoinCurves(Curves=flatten([line_sdl, line_sdl_2, rebuild_curve, line_8]), Preserve=False)

# ---- group: robot sim
curve_6 = Curve(join_curves)  # disabled
explode = Explode(Curve=curve_6, Recursive=True)  # -> Segments, Vertices; disabled
construct_plane_5 = ConstructPlane(Origin=explode.Vertices, XAxis=line_6, YAxis=cross_product_2.Vector)  # disabled
panel_14 = Panel("0.0 * Pi")  # disabled
number_slider_3 = Slider(1, range=0..1)  # disabled
rotate_plane_2 = RotatePlane(Plane=construct_plane_5, Angle=panel_14)  # -> simplify(Plane); disabled
flip_plane = FlipPlane(Plane=flatten(rotate_plane_2), ReverseX=False, ReverseY=False, SwapAxes=True)  # disabled
reverse_list = ReverseList(List=rotate_plane_2)  # disabled
boolean_toggle_2 = BooleanToggle(True)  # disabled
flip_plane_2 = FlipPlane(Plane=flip_plane, ReverseX=False, ReverseY=False, SwapAxes=True)  # disabled
panel_15 = Panel("1")  # disabled
interpolate_frames_2 = InterpolateFrames(Frames=flip_plane_2, Length=number_slider_3, Step=panel_15, Reset=boolean_toggle_2)  # -> Frame, Percent, CurrentIndex; disabled
predefined_spindle_end_effector = PredefinedSpindleEndEffector()  # disabled
predefined_kuka_kr_125_2_2 = PredefinedKUKAKR1252(RobRootFrame=PlaneXY(0, 0, 0), EndEffectorOptional=predefined_spindle_end_effector)  # disabled
robot_inverse_kinematics_2 = RobotInverseKinematics(
    Robot=predefined_kuka_kr_125_2_2,
    TargetTCPFrame=interpolate_frames_2.Frame,
    AxisToggles=[False, False, False],
    useColorPreview=True)  # -> PoseGeometry, AxisValues; disabled

# ---- group: gcode
deconstruct_plane = DeconstructPlane(Plane=flip_plane_2)  # -> Origin, XAxis, YAxis, ZAxis; disabled
list_length = ListLength(List=deconstruct_plane.Origin)  # disabled
panel_16 = Panel("G0")  # disabled
panel_17 = Panel("G1")  # disabled
repeat_data = RepeatData(Data=panel_17, Length=expr("x - 2", list_length))  # disabled
nc_settings = NCSettings(Tool=tool_no, Speed=spindle_speed_rpm, Feed=feed_mm_min)  # disabled
merge_2 = Merge(Data1=panel_16, Data2=flatten(repeat_data), Data3=panel_16)  # disabled
nc_generation = NCGeneration(Points=deconstruct_plane.Origin, Vectors=deconstruct_plane.ZAxis, Feed=merge_2, Settings=nc_settings)  # disabled
panel_18 = Panel("6")  # disabled
panel_19 = Panel("TCPZROT / -90.0")  # disabled
split = SplitList(List=nc_generation, Index=panel_18)  # -> ListA, ListB; disabled
merge_3 = Merge(Data1=flatten(split.ListA), Data2=panel_19, Data3=flatten(split.ListB))  # disabled

# ----
panel_20 = Panel(merge_3)  # disabled

# ---- group: plane for moving path
curve_7 = Curve(geometry_14)
divide_curve_3 = DivideCurve(Curve=reparameterize(curve_7), Count="10", Kinks=False)  # -> Points, Tangents, Parameters
evaluate_curve_3 = EvaluateCurve(Curve=reparameterize(curve_7), Parameter=divide_curve_3.Parameters)  # -> Point, Tangent, Angle
point_23 = Point(evaluate_curve_3.Point)
vector_8 = Vector(expr("-x", evaluate_curve_3.Tangent))
vector_display_ex_6 = VectorDisplayEx(Point=point_23, Vector=expr("x*100", vector_8), Colour=ColourSwatch(SwatchColor=RGB(255, 120, 120)), Width=2)
point_24 = Point(divide_curve_3.Points)

# ----
deconstruct_arc = DeconstructArc(Arc=curve_7)  # -> BasePlane, Radius, Angle
point_25 = Point(deconstruct_arc.BasePlane)
vector_2pt_8 = Vector2Pt(PointA=point_25, PointB=point_23, Unitize=True)  # -> Vector, Length

# ---- group: plane for moving path (continued)
cross_product_3 = CrossProduct(VectorA=evaluate_curve_3.Tangent, VectorB=vector_2pt_8.Vector, Unitize=True)  # -> Vector, Length
vector_9 = Vector(cross_product_3.Vector)
vector_display_ex_7 = VectorDisplayEx(Point=point_23, Vector=expr("x * 100", vector_9), Colour=ColourSwatch(SwatchColor=RGB(99, 212, 120)), Width=2)
vector_10 = Vector(vector_2pt_8.Vector)
vector_display_ex_8 = VectorDisplayEx(Point=point_23, Vector=expr("x * 100", vector_10), Colour=ColourSwatch(SwatchColor=RGB(8, 135, 255)), Width=2)
construct_plane_6 = ConstructPlane(Origin=point_24, XAxis=vector_8, YAxis=vector_9)  # -> simplify(graft(Plane))

# ----
flip_plane_3 = FlipPlane(Plane=construct_plane_6, ReverseX=False, ReverseY=False, SwapAxes=True)

# ---- group: plane for moving path (continued)
rotate_plane_3 = RotatePlane(Plane=flip_plane_3, Angle="0 * Pi")  # -> simplify(Plane)

# ----
plane_4 = Plane(rotate_plane_3)

# ---- group: robot simulation
invert_matrix_2 = InvertMatrix(Matrix=matrix, Tolerance=0)  # -> Matrix, Success
plane2matrix_2 = Plane2matrix(target=plane_4)
multiplication_2 = Multiplication(A=plane2matrix_2, B=invert_matrix_2.Matrix)
pose2plane_2 = Pose2plane(matrix=multiplication_2)  # -> flatten(plane)
predefined_kuka_kr_125_2_3 = PredefinedKUKAKR1252(RobRootFrame=PlaneXY(0, 0, 0))
interpolate_frames_3 = InterpolateFrames(Frames=flatten(pose2plane_2), Length=Slider(0.411, range=0..1), Step="1", Reset=Toggle(True))  # -> Frame, Percent, CurrentIndex
robot_inverse_kinematics_3 = RobotInverseKinematics(
    Robot=predefined_kuka_kr_125_2_3,
    TargetTCPFrame=interpolate_frames_3.Frame,
    AxisToggles=[False, False, False],
    useColorPreview=True)  # -> PoseGeometry, AxisValues

# ----
list_length_2 = ListLength(List=flatten(plane2matrix_2))
deconstruct_matrix = DeconstructMatrix(Matrix=flatten(plane2matrix_2))  # -> Rows, Columns, Values
text = Text(simplify(deconstruct_matrix.Values))
duplicate_data = DuplicateData(Data="]", Number=list_length_2, Order=True)  # -> simplify(graft(Data))
duplicate_data_2 = DuplicateData(Data="[", Number=list_length_2, Order=True)  # -> simplify(graft(Data))
panel_21 = Panel(plane2matrix_2)
text_join = TextJoin(Text=text, Join=", ")
panel_22 = Panel(text_join)
merge_4 = Merge(Data1=duplicate_data_2, Data2=text_join, Data3=duplicate_data)
panel_23 = Panel(merge_4)
panel_24 = Panel(robot_inverse_kinematics_3.AxisValues)

# ==== cluster Plane2matrix
xy_plane = XYPlane(Origin=Point(0, 0, 0))
target = ClusterInput()
orient = Orient(Source=xy_plane, Target=target)  # -> Geometry, Transform
matrix = Matrix(orient.Transform)
matrix_2 = ClusterOutput(matrix)

# ==== cluster Pose2plane
matrix = ClusterInput()
deconstruct_matrix = DeconstructMatrix(Matrix=matrix)  # -> Rows, Columns, Values
panel = Panel("""3
7
11""")
panel_2 = Panel("""0
4
8""")
panel_3 = Panel("""1
5
9""")
list_item = ListItem(List=deconstruct_matrix.Values, Index=panel, Wrap=True)
list_item_2 = ListItem(List=deconstruct_matrix.Values, Index=panel_2, Wrap=True)
list_item_3 = ListItem(List=deconstruct_matrix.Values, Index=panel_3, Wrap=True)
list_item_4 = ListItem(List=list_item, Index=0, Wrap=True)  # -> Item, Item1, Item2
list_item_5 = ListItem(List=list_item_2, Index=0, Wrap=True)  # -> Item, Item1, Item2
list_item_6 = ListItem(List=list_item_3, Index=0, Wrap=True)  # -> Item, Item1, Item2
construct_point = ConstructPoint(XCoordinate=list_item_4.Item, YCoordinate=list_item_4.Item1, ZCoordinate=list_item_4.Item2)
vector_xyz = VectorXYZ(XComponent=list_item_5.Item, YComponent=list_item_5.Item1, ZComponent=list_item_5.Item2)  # -> Vector, Length
vector_xyz_2 = VectorXYZ(XComponent=list_item_6.Item, YComponent=list_item_6.Item1, ZComponent=list_item_6.Item2)  # -> Vector, Length
construct_plane = ConstructPlane(Origin=construct_point, XAxis=vector_xyz.Vector, YAxis=vector_xyz_2.Vector)
plane = ClusterOutput(construct_plane)

# ==== cluster Cluster
curve = ClusterInput()
curve_2 = ClusterInput()
curve_3 = Curve(curve)
curve_4 = Curve(curve_2)
cross_product = CrossProduct(VectorA=curve_3, VectorB=curve_4, Unitize=False)  # -> Vector, Length
end_points = EndPoints(Curve=curve_3)  # -> Start, End
line_sdl = LineSDL(Start=end_points.Start, Direction=cross_product.Vector, Length=1)
plane_3pt = Plane3Pt()
line_line = LineLine(LineA=curve_3, LineB=line_sdl)
line_plane = LinePlane(Line=curve_4, Plane=line_line)  # -> Point, ParamL, ParamP
point = ClusterOutput(line_plane.Point)

# ==== cluster Cluster_2
curve = ClusterInput()
curve_2 = Curve(curve)
vector_a = ClusterInput()
A = ClusterInput()
B = ClusterInput()
angle = Angle(VectorA=vector_a, VectorB=curve_2)  # -> Angle, Reflex
maximum = Maximum(A=A, B=B)
sine = Sine(Value=angle.Angle)
multiplication = Multiplication(A=maximum, B="1.2/2")
division = Division(A=multiplication, B=sine)
vector = Vector(curve_2)
point = ClusterInput()
multiplication_2 = Multiplication(A=vector, B=division)
point_2 = Point(point)
move = Move(Geometry=point_2, Motion=expr("-x", multiplication_2))  # -> Geometry, Transform
move_2 = Move(Geometry=point_2, Motion=multiplication_2)  # -> Geometry, Transform
geometry = ClusterOutput(move_2.Geometry)
geometry_2 = ClusterOutput(move.Geometry)
