# Grasshopper definition tolerance_study.gh (Grasshopper 1.0.7)
# plug-ins: Kangaroo2 Components, plankton, ICD.AbmFramework.Grasshopper

# Turn me on!   -->
python = PythonScript()  # -> rhino_doc_dir
# ---------- python: Python ----------
import scriptcontext as sc
from os import path

rhino_doc_dir = path.abspath(path.dirname(sc.doc.Path))
# ---------- end python ----------
panel = Panel("10.0")
list = ValueList({"CRITICAL", "ERROR", "WARNING", "INFO", "DEBUG", "NOTSET"}, selected="DEBUG")

# ---- group: Import remote python modules
panel_2 = Panel(python)
panel_3 = Panel("""numpy
numpy.linalg
cvxopt""")
ghpythonremote = GHPythonRemote(location="conda://rhinoremote", run=Toggle(True), modules=panel_3, log_level=list, working_dir=panel_2)  # -> out, linked_modules, rpy; inputs run: Boolean, modules: list
# ---------- ghpythonremote: Python ----------
import sys
import scriptcontext
import logging
import inspect
import ghpythonremote
from ghpythonremote.connectors import GrasshopperToPythonRemote
from os import path
from time import sleep

local_log_level = getattr(logging, log_level, logging.WARNING)
logger = logging.getLogger('ghpythonremote')
logger.setLevel(local_log_level)
ch = logging.StreamHandler()
ch.setLevel(local_log_level)
formatter = logging.Formatter('%(levelname)s: %(name)s:\n%(message)s')
ch.setFormatter(formatter)
logger.handlers = []
logger.addHandler(ch)
logger = logging.getLogger('ghpythonremote.GH_to_python')

ROOT = path.abspath(path.dirname(inspect.getfile(ghpythonremote)))
rpyc_server_py = path.join(ROOT, 'pythonservice.py')

# Set connection to CLOSED if this is the first run
# and initialize set of linked modules
try:
    remote_python_status
except NameError:
    remote_python_status = 'CLOSED'
    lkd_modules = set()

# Wait for connection to connect or terminate
timer = 0
while remote_python_status == 'CONNECTING' or remote_python_status == 'CLOSING':
    sleep(1)
    timer += 1
    if timer == 10:
        try:
            gh2py_manager.__exit__(*sys.exc_info())
        except Exception:
            pass
        remote_python_status = 'CLOSED'
        lkd_modules = set()
        raise RuntimeError("Connection left in an inconsistent state and not returning. Reset everything.")

if run:
    if not remote_python_status == 'OPEN':
        remote_python_status = 'CONNECTING'
        gh2py_manager = GrasshopperToPythonRemote(rpyc_server_py, location=location, timeout=10,
                                                  port=None, log_level=log_level, working_dir=working_dir)
        gh2py = gh2py_manager.__enter__()
        remote_python_status = 'OPEN'

    # Stuff that we can reach
    rpymod = gh2py.py_remote_modules  # A getter function for a named python module
    rpy = gh2py.connection  # Represents the remote instance root object
    scriptcontext.sticky['rpy'] = rpy
    # Add modules
    for mod in modules:
        try:
            scriptcontext.sticky[mod] = rpymod(mod)
            lkd_modules.add(mod)
        except ImportError:
            gh2py_manager.__exit__(*sys.exc_info())
            raise

elif not remote_python_status == 'CLOSED':
    remote_python_status = 'CLOSING'
    # Remove linked modules
    for mod in lkd_modules:
        del scriptcontext.sticky[mod]
    del scriptcontext.sticky['rpy']
    gh2py_manager.__exit__(*sys.exc_info())
    lkd_modules = set()
    remote_python_status = 'CLOSED'

# Change variable name because ghpython resets outputs to None before each run
linked_modules = lkd_modules

logger.info('GH to python connection is {}'.format(remote_python_status))
# ---------- end ghpythonremote ----------
panel_4 = Panel(ghpythonremote.out)

# ----
number_slider = Slider(1, range=0..1)  # disabled
python_2 = PythonScript(module_names=ghpythonremote.linked_modules)  # -> import_statements; inputs module_names: list
# ---------- python_2: Python ----------
import_statements = ["import scriptcontext as sc"]
for module_name in module_names:
    import_statements.append("{0} = sc.sticky['{0}']".format(module_name))

if len(module_names) == 0:
    import_statements = []
# ---------- end python_2 ----------
curve = Curve([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])  # disabled

number_slider_2 = Slider(1, range=0..1)  # disabled
panel_5 = Panel("2")  # disabled
panel_6 = Panel("800")  # disabled
# generating planar cells
surface = Surface(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)  # disabled
separate = DefineSeparationBehavior(SeparationDistance=panel_6, Weight=number_slider_2, Power=panel_5, AffectSelf=True)  # disabled
area = Area(Geometry=surface)  # -> Area, Centroid; disabled
ghpython_script = GhPythonScript(x=panel_6)  # -> a; disabled
# ---------- ghpython_script: Python ----------
from math import pi

a = pi * x * x / 4.0
# ---------- end ghpython_script ----------
division = Division(A=area.Area, B=ghpython_script)  # disabled
populate_geometry = PopulateGeometry(Geometry=surface, Count=expr("1.4*x", division), Seed=1)  # disabled
list_length = ListLength(List=populate_geometry)  # disabled
c_script = CSharpScript(iCount=list_length)  # -> out, A, B, C; inputs iCount: Int32; disabled
# ---------- c_script: C# ----------
    List<double> X = new List<double>();
    List<double> Y = new List<double>();
    List<double> Z = new List<double>();
    Random random = new Random(5);
    double range = 10.0;
    for (int i = 0; i < iCount; i++){
      X.Add(range * (random.NextDouble() * 2.0 - 1.0));
      Y.Add(range * (random.NextDouble() * 2.0 - 1.0));
      Z.Add(range * (random.NextDouble() * 2.0 - 1.0));
    }
    A = X;
    B = Y;
    C = Z;
# ---------- end c_script ----------
vector_xyz = VectorXYZ(XComponent=c_script.A, YComponent=c_script.B, ZComponent=c_script.C)  # -> Vector, Length; disabled
define_multi_brep_environment = DefineMultiBrepEnvironment(Breps=surface)  # disabled
define_boid = DefineBoid(Positions=populate_geometry, Velocities=vector_xyz.Vector, Behaviors=separate)  # disabled
panel_7 = Panel("0.00001")  # disabled
panel_8 = Panel("5")  # disabled
define_boid_system = DefineBoidSystem(
    SurfaceEnvironment=define_multi_brep_environment,
    BoidAgents=define_boid,
    DisplacementThreshold=panel_7,
    Timestep=panel_8)  # disabled
boolean_toggle = BooleanToggle(False)  # disabled
button = Button()  # disabled
step_by_step_solver = StepByStepSolver(Reset=button, Execute=boolean_toggle, AgentSystems=define_boid_system)  # -> DisplayGeometries, AllAgentSystems, IterationCount; disabled
total_displacement = Panel(step_by_step_solver.IterationCount)  # disabled
c_script_2 = CSharpScript(BS=step_by_step_solver.AllAgentSystems, Reference="C:\USERS\77777777\DESKTOP\ICD.ABMFRAMEWORK\ICD.AbmFramework.Core.dll")  # -> out, A; disabled
# ---------- c_script_2: C# usings ----------
using ICD.AbmFramework.Core;
using ICD.AbmFramework.Core.Agent;
using ICD.AbmFramework.Core.AgentSystem;
using ICD.AbmFramework.Core.Behavior;
using ICD.AbmFramework.Core.Environments;
# ---------- c_script_2: C# ----------
    Vector3d totalDisplacement = Vector3d.Zero;

    var system = (BoidSystem) BS;

    foreach (Boid agent in  system.Agents)
      totalDisplacement += agent.Velocity;

    A = totalDisplacement.Length;
# ---------- end c_script_2 ----------
dispatch = Dispatch(List=step_by_step_solver.DisplayGeometries, DispatchPattern=[True, False])  # -> ListA, ListB; disabled
total_displacement_2 = Panel(c_script_2.A)  # disabled
vector_display = VectorDisplay(Anchor=dispatch.ListA, Vector=dispatch.ListB)  # disabled
point = Point(dispatch.ListA)  # disabled
surface_2 = Surface(surface)  # disabled
deconstruct_domain² = DeconstructDomain²(Domain=surface_2)  # -> UMin, UMax, VMin, VMax; disabled
surface_closest_point = SurfaceClosestPoint(Point=point, Surface=surface)  # -> Point, UVPoint, Distance; disabled
surface_closest_point_2 = SurfaceClosestPoint(Point=point, Surface=surface_2)  # -> Point, UVPoint, Distance; disabled
construct_point = ConstructPoint(XCoordinate=0, YCoordinate=deconstruct_domain².VMax, ZCoordinate=0)  # disabled
construct_point_2 = ConstructPoint(XCoordinate=deconstruct_domain².UMax, YCoordinate=deconstruct_domain².VMax, ZCoordinate=0)  # disabled
evaluate_surface = EvaluateSurface(Surface=surface, Point=surface_closest_point.UVPoint)  # -> Point, Normal, UDirection, VDirection, Frame; disabled
construct_point_3 = ConstructPoint(XCoordinate=deconstruct_domain².UMax, YCoordinate=0, ZCoordinate=0)  # disabled
_4point_surface = _4PointSurface(CornerA=Point(0, 0, 0), CornerB=construct_point_3, CornerC=construct_point_2, CornerD=construct_point)  # disabled
voronoi = Voronoi(Points=surface_closest_point_2.UVPoint, Boundary=_4point_surface, BruteForceOverride=False)  # disabled
plane_normal = PlaneNormal(Origin=point, ZAxis=evaluate_surface.Normal)  # disabled
map_to_surface = MapToSurface(Curve=voronoi, Source=_4point_surface, Target=surface_2)  # disabled
circle = Circle(Plane=plane_normal, Radius=expr("x * 0.5", panel_6))  # disabled

mean = Slider(0, range=0..20)
stddev = Slider(10, range=0..20)
curve_2 = Curve([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])
panel_9 = Panel("2")  # disabled
panel_10 = Panel("800")  # disabled
curve_3 = Curve([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])  # disabled

# ----
# sorting curves
colour_swatch = ColourSwatch(SwatchColor=RGB(214, 214, 214))  # disabled
ghpython_script_2 = GhPythonScript(polylines=curve_3)  # -> centers; inputs polylines: list of Polyline; disabled
# ---------- ghpython_script_2: Python ----------
import Rhino.Geometry as rg

centers = []
for polyline in polylines:
    center = rg.Point3d.Origin
    for index in range(polyline.Count-1):
        center += polyline[index]
    centers.append(center/(polyline.Count-1))
# ---------- end ghpython_script_2 ----------
custom_preview = CustomPreview(Geometry=curve_3, Material=colour_swatch)  # disabled
average = Average(Input=ghpython_script_2)  # disabled
subtraction = Subtraction(A=ghpython_script_2, B=average)  # disabled
ghpython_script_3 = GhPythonScript(points=subtraction)  # -> metric; inputs points: list of Point3d; disabled
# ---------- ghpython_script_3: Python ----------
import Rhino.Geometry as rg

metric = []
for point in points:
    metric.append(point.Y * 15.0 + point.X)
# ---------- end ghpython_script_3 ----------
sort_list = SortList(Keys=ghpython_script_3, ValuesValuesA=curve_3, ValuesA=ghpython_script_2)  # -> Keys, ValuesValuesA, ValuesA; disabled
panel_11 = Panel("100")  # disabled
point_list = PointList(Points=sort_list.ValuesA, Size=panel_11)  # disabled

surface_3 = Surface(<surface referenced from the Rhino model>)  # disabled
ghpython_script_4 = GhPythonScript(polylines=curve_2)  # -> centers; inputs polylines: list of Polyline; same code as ghpython_script_2
separate_2 = DefineSeparationBehavior(SeparationDistance=panel_10, Weight=number_slider, Power=panel_9, AffectSelf=True)  # disabled
panel_12 = Panel(python_2)
custom_preview_2 = CustomPreview(Geometry=curve_2, Material=ColourSwatch(SwatchColor=RGB(148, 148, 148)))
area_2 = Area(Geometry=surface_3)  # -> Area, Centroid; disabled
test_distribution = CSharpScript(
    stddev=stddev,
    Reference="C:\Users\77777777\source\repos\machine_perception\design\tolerance_study\libs\MathNet.Numerics.dll")  # -> out, A; inputs stddev: Double
# ---------- test_distribution: C# usings ----------
using MathNet.Numerics.Distributions;
# ---------- test_distribution: C# ----------
    //    for (int i = 0; i < Vectors.BranchCount; i++)
    //    {
    //      double noiseX = Normal.Sample(0.0, stddev);
    //      double noiseY = Normal.Sample(0.0, stddev);
    //    }

    List<double> Numbers = new List<double>();
    List<Point3d> Points = new List<Point3d>();
    for (int i = 0; i < 10000; i++)
    {
      double x = Normal.Sample(0.0, stddev);
      Numbers.Add(x);
    }

    List<int> counts = new List<int>();
    for (int i = 0; i < 100; i++)
    {
      counts.Add(0);
    }
    for (int i = 0; i < Numbers.Count; i++)
    {
      double index_d = Math.Floor(Math.Abs(Numbers[i]));
      int index_i = (int) index_d;
      counts[index_i] += 1;
    }
    for (int i = 0; i < 100; i++)
    {
      Points.Add(new Point3d(i, counts[i] / 10.0, 0.0));
    }
    A = Points;
# ---------- end test_distribution ----------

explode = Explode(Curve=curve_2, Recursive=True)  # -> Segments, simplify(Vertices)
shift_list = ShiftList(List=explode.Vertices, Shift=1, Wrap=False)  # -> simplify(List)
removeduplicatepts = RemoveDuplicatePts(Points=flatten(shift_list), Tolerance=0.01)
point_list_2 = PointList(Points=removeduplicatepts, Size=40)
closest_point = ClosestPoint(Point=shift_list, Cloud=removeduplicatepts)  # -> ClosestPoint, CPIndex, Distance
c_script_3 = CSharpScript(
    points=removeduplicatepts,
    Indices=closest_point.CPIndex,
    Reference="C:\Users\77777777\source\repos\machine_perception\design\tolerance_study\libs\Plankton.dll")  # -> out, oMesh, A, B, C; inputs points: list of Point3d, Indices: tree of Int32
# ---------- c_script_3: C# usings ----------
using Plankton;
# ---------- c_script_3: C# ----------
    PlanktonMesh mesh = new PlanktonMesh();
    for (int i = 0; i < points.Count; i++)
    {
      mesh.Vertices.Add(points[i].X, points[i].Y, points[i].Z);
    }
    for (int i = 0; i < Indices.BranchCount; i++)
    {
      mesh.Faces.AddFace(Indices.Branch(i));
    }

    oMesh = mesh;

    //    A = mesh.Faces.GetFaceVertices(25);
    //    B = mesh.Faces.GetHalfedges(25);
    //    int index = mesh.Halfedges.GetPairHalfedge(117);
    //    C = mesh.Halfedges[index].AdjacentFace;
# ---------- end c_script_3 ----------
planktonmesh = PlanktonMesh(c_script_3.oMesh)
panel_13 = Panel(c_script_3.C)

ghpython_script_5 = GhPythonScript(x=panel_10)  # -> a; disabled; same code as ghpython_script
vector_2pt = Vector2Pt(PointA=simplify(graft(ghpython_script_4)), PointB=shift_list, Unitize=False)  # -> Vector, Length
vector = Vector(vector_2pt.Vector)
c_script_4 = CSharpScript(
    Vectors=vector,
    mean=mean,
    stddev=stddev,
    Reference="C:\Users\77777777\source\repos\machine_perception\design\tolerance_study\libs\MathNet.Numerics.dll")  # -> out, oNoiseVectors, oVectors; inputs Vectors: tree of Vector3d, mean: Double, stddev: Double
# ---------- c_script_4: C# ----------
    DataTree<Vector3d> noiseVectors = new DataTree<Vector3d>();
    DataTree<Vector3d> newVectors = new DataTree<Vector3d>();
    for (int i = 0; i < Vectors.BranchCount; i++)
    {
      GH_Path pth = new GH_Path(i);
      for (int j = 0; j < Vectors.Branch(i).Count; j++)
      {
        double noiseX = Normal.Sample(mean, stddev);
        double noiseY = Normal.Sample(mean, stddev);
        if (Vectors.Branch(i)[j].X < 0)
          noiseX *= -1.0;
        if (Vectors.Branch(i)[j].Y < 0)
          noiseY *= -1.0;
        Vector3d noiseVector = new Vector3d(noiseX, noiseY, 0.0);
        noiseVectors.Add(noiseVector, pth);
        Vector3d vecWithNoise = noiseVector + Vectors.Branch(i)[j];
        newVectors.Add(vecWithNoise, pth);
      }
    }

    oNoiseVectors = noiseVectors;
    oVectors = newVectors;
# ---------- end c_script_4 ----------
xy_plane = XYPlane(Origin=ghpython_script_4)
plane = Plane(xy_plane)
point_2 = Point(plane)
point_list_3 = PointList(Points=ghpython_script_4, Size=60)
division_2 = Division(A=area_2.Area, B=ghpython_script_5)  # disabled

addition = Addition(A=c_script_4.oVectors, B=simplify(graft(point_2)))
polyline = PolyLine(Vertices=addition, Closed=True)
unit_y = UnitY(Factor="-3000")
move = Move(Geometry=polyline, Motion=unit_y)  # -> Geometry, Transform
colour_swatch_2 = ColourSwatch(SwatchColor=RGB(115, 115, 115))
custom_preview_3 = CustomPreview(Geometry=move.Geometry, Material=ColourSwatch(SwatchColor=RGB(214, 214, 214)))

panel_14 = Panel(c_script_4.oNoiseVectors)
populate_geometry_2 = PopulateGeometry(Geometry=surface_3, Count=expr("1.5*x", division_2), Seed=1)  # disabled
list_length_2 = ListLength(List=populate_geometry_2)  # disabled

# ---- group: Use numpy, click to open and run
python_3 = PythonScript()  # -> out, a
# ---------- python_3: Python ----------
import scriptcontext
import ghpythonremote
np = scriptcontext.sticky['numpy']
rpy = scriptcontext.sticky['rpy']
# Do some numpy stuff
a = np.arange(15).reshape(3, 5)
print(a)
print(np.linalg.eig(np.arange(9).reshape(3, 3)))

# Fast way of sending data for numpy array creation
remote_range = ghpythonremote.deliver(rpy, range(1000))
array = np.array(remote_range)
# This is much slower
#b = np.array(range(1000))

# Get the array back as a local IronPython list
list = ghpythonremote.obtain(array.tolist())

# Get an error
#np.arange(9).reshape(4,3)
# ---------- end python_3 ----------
panel_15 = Panel(python_3.out)

# ----
panel_16 = Panel(vector_2pt.Vector)
c_script_5 = CSharpScript(iCount=list_length_2)  # -> out, A, B, C; inputs iCount: Int32; disabled; same code as c_script
vector_xyz_2 = VectorXYZ(XComponent=c_script_5.A, YComponent=c_script_5.B, ZComponent=c_script_5.C)  # -> Vector, Length; disabled
define_multi_brep_environment_2 = DefineMultiBrepEnvironment(Breps=surface_3)  # disabled
define_boid_2 = DefineBoid(Positions=populate_geometry_2, Velocities=vector_xyz_2.Vector, Behaviors=separate_2)  # disabled
panel_17 = Panel("0.00001")  # disabled
panel_18 = Panel("5")  # disabled
define_boid_system_2 = DefineBoidSystem(
    SurfaceEnvironment=define_multi_brep_environment_2,
    BoidAgents=define_boid_2,
    DisplacementThreshold=panel_17,
    Timestep=panel_18)  # disabled
boolean_toggle_2 = BooleanToggle(False)  # disabled
button_2 = Button()  # disabled
deconstructplankton = DeconstructPlankton(PMesh=planktonmesh)  # -> Vertex_Points, Vertex_Outgoing_Halfedge, Halfedge_StartVertex, Halfedge_AdjacentFace, Halfedge_NextHalfedge, Halfedge_PrevHalfedge, Halfedge_Pair, Face_Halfedge
step_by_step_solver_2 = StepByStepSolver(Reset=button_2, Execute=boolean_toggle_2, AgentSystems=define_boid_system_2)  # -> DisplayGeometries, AllAgentSystems, IterationCount; disabled
total_displacement_3 = Panel(step_by_step_solver_2.IterationCount)  # disabled
read_file = ReadFile(File="C:\Users\77777777\source\repos\machine_perception\design\tolerance_study\fit_pieces.py", PerLineParse=False)
c_script_6 = CSharpScript(
    BS=step_by_step_solver_2.AllAgentSystems,
    Reference="C:\USERS\77777777\DESKTOP\ICD.ABMFRAMEWORK\ICD.AbmFramework.Core.dll")  # -> out, A; disabled; same code as c_script_2
dispatch_2 = Dispatch(List=step_by_step_solver_2.DisplayGeometries, DispatchPattern=[True, False])  # -> ListA, ListB; disabled
panel_19 = Panel(deconstructplankton.Halfedge_NextHalfedge)
panel_20 = Panel(deconstructplankton.Halfedge_AdjacentFace)
vertex_points = GhPythonScript(
    Code=read_file,
    Vertices=deconstructplankton.Vertex_Points,
    Edge_Start=deconstructplankton.Halfedge_StartVertex,
    Edge_Next=deconstructplankton.Halfedge_NextHalfedge,
    Face_StartEdge=deconstructplankton.Face_Halfedge,
    Edge_Pair=deconstructplankton.Halfedge_Pair,
    Edge_Face=deconstructplankton.Halfedge_AdjacentFace,
    N=Slider(1, range=0..10),
    Noise_vectors=c_script_4.oNoiseVectors,
    Cell_Poses=xy_plane)  # -> Out, A, B
total_displacement_4 = Panel(c_script_6.A)  # disabled
vector_display_2 = VectorDisplay(Anchor=dispatch_2.ListA, Vector=dispatch_2.ListB)  # disabled
panel_21 = Panel(vertex_points.Out)
curve_4 = Curve(vertex_points.A)

point_3 = Point(dispatch_2.ListA)  # disabled
surface_closest_point_3 = SurfaceClosestPoint(Point=point_3, Surface=surface_3)  # -> Point, UVPoint, Distance; disabled
evaluate_surface_2 = EvaluateSurface(Surface=surface_3, Point=surface_closest_point_3.UVPoint)  # -> Point, Normal, UDirection, VDirection, Frame; disabled
plane_normal_2 = PlaneNormal(Origin=point_3, ZAxis=evaluate_surface_2.Normal)  # disabled
circle_2 = Circle(Plane=plane_normal_2, Radius=expr("x * 0.5", panel_10))  # disabled

surface_4 = Surface(surface_3)  # disabled
deconstruct_domain²_2 = DeconstructDomain²(Domain=surface_4)  # -> UMin, UMax, VMin, VMax; disabled
surface_closest_point_4 = SurfaceClosestPoint(Point=point_3, Surface=surface_4)  # -> Point, UVPoint, Distance; disabled
construct_point_4 = ConstructPoint(XCoordinate=0, YCoordinate=deconstruct_domain²_2.VMax, ZCoordinate=0)  # disabled
construct_point_5 = ConstructPoint(XCoordinate=deconstruct_domain²_2.UMax, YCoordinate=deconstruct_domain²_2.VMax, ZCoordinate=0)  # disabled
construct_point_6 = ConstructPoint(XCoordinate=deconstruct_domain²_2.UMax, YCoordinate=0, ZCoordinate=0)  # disabled
_4point_surface_2 = _4PointSurface(CornerA=Point(0, 0, 0), CornerB=construct_point_6, CornerC=construct_point_5, CornerD=construct_point_4)  # disabled
voronoi_2 = Voronoi(Points=surface_closest_point_4.UVPoint, Boundary=_4point_surface_2, BruteForceOverride=False)  # disabled
map_to_surface_2 = MapToSurface(Curve=voronoi_2, Source=_4point_surface_2, Target=surface_4)  # disabled
